% Simulink data dictionary LCplanning.sldd

Var = 0

VSI_VEHSTATE_ST = Simulink.Bus(DataScope="Imported", HeaderFile="adaptes.h")
  YrsF: single
  AxSensorF: single
  StWheelAngleF: single
  vRef: single
  aRef: single
  AxSlope: single
  AxSlopeValid: boolean
  Curvature: single

PlanningOutput = Simulink.Bus()  % the output contains infomation as follow:
  % 1,2 cols: under vehicle coordinate, the x,y positions of planned
  % trajectories;
  % 3,4 cols: w.r.t longitudinal intergration s, the lateral offset on
  % each sampled s, offset to left of reference line is positive, and
  % the other side is negative;
  % 5 cols: delta_heading of matched point vectors between reference
  % line and planned trajs, anti-clock wise from reference to planned
  % trajs is positive;
  % 6 cols: planned trajs kappa, vehicle turing left is positive and
  % turning right is negative;
  % 7 cols: velocity profile along the planned trajectory.
  % 8 cols: acceleration profile along the planned trajectory.
  x: double[500]
  y: double[500]
  s: double[500]
  lat_offset: double[500]
  delta_theta: double[500]
  kappa: double[500]
  v_profile: double[500]
  a_profile: double[500]

vehStates = Simulink.Bus()
  vel_lon: double
  acc_lon: double
  vel_lat: double
  acc_lat: double

lanePoly = Simulink.Bus()
  A0: double
  A1: double
  A2: double
  A3: double
  B0: double
  B1: double
  B2: double
  B3: double
  C0: double
  C1: double
  C2: double
  C3: double

ObjInfo = Simulink.Bus()
  ID: double  % selected object ID, if it does not exist, should be zero
  dist: double  % should always be positive or at least zero
  v: double  % velocity to ground
  v_lat: double  % velocity w.r.t ego vehicle
  acc_lat: double  % acceleration w.r.t ego vehicle

SelectedObject = Simulink.Bus()
  A: Bus: ObjInfo
  B: Bus: ObjInfo
  C: Bus: ObjInfo
  D: Bus: ObjInfo

SelectObj = Simulink.Signal()