% Simulink data dictionary ARS308_RX.sldd

Bus_308 = Simulink.Bus()
  RCS: single
  DynProp: single
  VrelLat: single
  VrelLong: single
  DistLat: single
  DistLong: single
  ID: single

Header_308 = Simulink.Bus()
  ObjNum: single
  tStamp: single
  Version: single

BusArray_308 = Simulink.Bus()
  objects: Bus: Bus_308[40]

ARS308_RX = Simulink.Bus()
  leftFrontRadar_General: Bus: Bus_308[40]
  LeftFrontRadar_Status: Bus: Header_308
  rightFrontRadar_General: Bus: Bus_308[40]
  rightFrontRadar_Status: Bus: Header_308
  rightRearRadar_General: Bus: Bus_308[40]
  rightRearRadar_Status: Bus: Header_308
  leftRearRadar_General: Bus: Bus_308[40]
  leftRearRadar_Status: Bus: Header_308