% Simulink data dictionary AVP.sldd

AVP_OUTPUT_ST = Simulink.Bus()
  Tractory_c0: single
  Tractory_c1: single
  Tractory_c2: single
  Tractory_c3: single
  EndPoint_x: single
  EndPoint_y: single
  AVP_STATE: uint8  % The AVP_STATE indicaes the state of AVP and detail as below:
    % 00: Invalid
    % 01:Parking In
    % 02:Parking Out
    % 03:Stop