% Simulink data dictionary AccTarSel.sldd
% references Func_Global.sldd

P_tCurvFilt = Simulink.Parameter(0.2, DataType="single", Unit="s")
P_tDyToTrajFilt = Simulink.Parameter(0.5, DataType="single")
P_dyCutInThres = Simulink.Parameter(3.6, DataType="single")
inputStruct = Simulink.Signal()
t_temp = Simulink.Signal(DataType="Bus: ATS_INTERNAL_OBJINFO_ST")
P_dvarYMax4PO = Simulink.Parameter(1, DataType="single")
P_probExistMin4PO = Simulink.Parameter(0.8, DataType="single")
P_plausMin4PO = Simulink.Parameter(0.5, DataType="single")
P_tSSCPos = Simulink.Parameter(5.5, DataType="single")
P_vFOCNegDiff = Simulink.Parameter(4, DataType="single")
P_vyCutInThres = Simulink.Parameter(0.5)
P_dResMax = Simulink.Parameter(5, DataType="single")
P_facBDCInit = Simulink.Parameter(0.7, DataType="single")
P_facBDCIterCalc = Simulink.Parameter(0.8, DataType="single")
P_dObjDrvOffMin = Simulink.Parameter(3, DataType="single")

ATS_OBJINFO_ST = Simulink.Bus()
  dx: single
  dy: single
  vx: single
  vy: single
  dyToTraj: single
  dyCutInPred: single
  probCutInRaw: single
  probCutInFilt: single
  probEgoLane: single
  plausEgoLane: single
  ValidEgoLane: boolean
  ID: single

P_tCutInFilt = Simulink.Parameter(0.5, DataType="single")
P_vObjNoStop = Simulink.Parameter(1, DataType="single")
P_tToStopInBDC = Simulink.Parameter(6, DataType="single")
P_vObjReCalc = Simulink.Parameter(1, DataType="single")
P_vObjStop = Simulink.Parameter(0.3, DataType="single")
P_adtMaxBDC = Simulink.Parameter(1, DataType="single")
P_tToStopTrig = Simulink.Parameter(4, DataType="single")
P_tToStop = Simulink.Parameter(5, DataType="single", Unit="s")
P_vEgoLowBDC = Simulink.Parameter(4, DataType="single")
EME_BasicInput_st = Simulink.Signal(DataType="Bus: EME_BASICINPUT_ST")

EME_BASICINPUT_ST = Simulink.Bus()
  vRef: single
  aRef: single
  kapTraj: single

FUS_OBJDATA_SIMU_ST = Simulink.Bus()
  timeStamp: double
  objdata_st: Bus: OBJDATA_ST

TRAJ_LANE_ST = Simulink.Bus()
  aParabola: single
  dParabola: single
  cParabola: single
  bParabola: single

AST_Info_st = Simulink.Signal(DataType="Bus: AST_INFO_ST")

AST_INFO_ST = Simulink.Bus()
  MainState: single
  vSet: single
  tMinInDrv: single

ATS_Internal_ObjInfo_st = Simulink.Signal(DataType="Bus: ATS_INTERNAL_OBJINFO_ST")

ATS_INTERNAL_OBJINFO_ST = Simulink.Bus()
  tmeStamp: double
  ats_obj_st: Bus: ATS_OBJINFO_ST[40]

P_StandObjEnable = Simulink.Parameter(0, DataType="boolean")
P_vEgoDecToStop = Simulink.Parameter(3, DataType="single")
P_vStandStill = Simulink.Parameter(0.3, DataType="single")
P_vStandStillHyst = Simulink.Parameter(0.3, DataType="single")
P_tMinDrvPhase = Simulink.Parameter(2, DataType="single")
P_tFiltVxAxPOFast = Simulink.Parameter(0.15, DataType="single")
P_tFiltVxAxPOSlow = Simulink.Parameter(0.25, DataType="single")
P_PlausIntegDisable = Simulink.Parameter(0, DataType="boolean")
P_vFOCStationarySlow = Simulink.Parameter(5, DataType="single")
P_tBDCStartFilt = Simulink.Parameter(0.2, DataType="single")
P_dStandStill = Simulink.Parameter(3, DataType="single")
P_dStandStillMin = Simulink.Parameter(2, DataType="single")
P_tRollingFinFilt = Simulink.Parameter(1, DataType="single")
P_tRollingFilt = Simulink.Parameter(0.5, DataType="single")
P_vFOCPosDiff = Simulink.Parameter(5, DataType="single")
P_dAimMin = Simulink.Parameter(4.5, DataType="single")
P_dObjLowHystDecToStop = Simulink.Parameter(4.5, DataType="single")
P_facFOCPosDiff = Simulink.Parameter(0.2, DataType="single")
P_kapHystThres = Simulink.Parameter(0.0005, DataType="single")
P_tTimeGapSet = Simulink.Parameter(1.8, DataType="single")
P_dObjUpperHystDecToStop = Simulink.Parameter(5, DataType="single")
P_vObjUpperHystDecToStop = Simulink.Parameter(0.8, DataType="single")
P_vObjLowHystDecToStop = Simulink.Parameter(0.5, DataType="single")
P_tAxTrackNegLower = Simulink.Parameter(0.3, DataType="single")
P_tAxTrackNegUpper = Simulink.Parameter(0.6, DataType="single")
P_tFiltAxAbsPONegSlow = Simulink.Parameter(0.4, DataType="single")
P_tFiltAxAbsPONegFast = Simulink.Parameter(0.1, DataType="single")
P_tFiltAxAbsPOPosSlow = Simulink.Parameter(2, DataType="single")
P_tFiltAxAbsPOPosFast = Simulink.Parameter(1.2, DataType="single")
P_tFiltAxAbsPOStand = Simulink.Parameter(2, DataType="single")
P_tPredObjLeav = Simulink.Parameter(1.2, DataType="single")
P_tFiltDsd = Simulink.Parameter(0.1, DataType="single")
P_tFiltDAim = Simulink.Parameter(0.1, DataType="single")
P_tAxTrackPosLower = Simulink.Parameter(1, DataType="single")
P_tAxTrackPosUpper = Simulink.Parameter(2, DataType="single")
P_tCSC = Simulink.Parameter(3.5, DataType="single")
P_tFiltSpdLim = Simulink.Parameter(3, DataType="single")
P_tSSCNeg = Simulink.Parameter(4.5, DataType="single")
P_aFOCApproachIntpAcitve = Simulink.Parameter(-0.6, DataType="single")
P_aFOCApproachIntpEnsure = Simulink.Parameter(-1.8, DataType="single")
P_CutInEnable = Simulink.Parameter(1, DataType="boolean")
P_dObjDrvOffMax = Simulink.Parameter(5, DataType="single")
P_vObjDrvOff = Simulink.Parameter(0.5, DataType="single")

ACC_FOC_INFO_ST = Simulink.Bus()
  Valid: boolean
  aFOC: single
  DecToStop: boolean
  FirstCyc: boolean
  dAim: single
  aStat: single
  aApproach: single
  ApproachCase: single
  tObjStop: single
  dSlowDown: single
  ObjLeaving: boolean
  dImmerseAdj: single

P_facFOCNegDiff = Simulink.Parameter(0.3, DataType="single")
P_tFOCStatDecelFast = Simulink.Parameter(4, DataType="single")
P_vFOCStationaryFast = Simulink.Parameter(15, DataType="single")
P_tFOCStatAccelSlow = Simulink.Parameter(3.5, DataType="single")
P_tFOCStatAccelFast = Simulink.Parameter(4, DataType="single")
P_tFOCStatDecelSlow = Simulink.Parameter(3.2, DataType="single")
P_dObjLowHystDecToStopAVP = Simulink.Parameter(1.5, DataType="single")
P_dAimMinAVP = Simulink.Parameter(1.5, DataType="single")