% Simulink data dictionary EYEQ4_RX.sldd

OBJECT_FRAME_INFO = Simulink.Bus()
  FrameID: single
  DaytimeIndicator: single
  SyncID: single

OBJECT_ST = Simulink.Bus()
  OBJ_ID: single
  OBJ_Existence_Probability: single
  OBJ_Right_Out_Of_Image: single
  OBJ_Left_Out_Of_Image: single
  OBJ_Top_Out_Of_Image: single
  OBJ_Bottom_Out_Of_Image: single
  OBJ_Age_Seconds: single
  OBJ_Width: single
  OBJ_Length: single
  OBJ_Height: single
  OBJ_Abs_Long_Velocity: single
  OBJ_Abs_Long_Velocity_STD: single
  OBJ_Abs_Lat_Velocity: single
  OBJ_Abs_Lat_Velocity_STD: single
  OBJ_Abs_Long_Acc: single
  OBJ_Abs_Long_Acc_STD: single
  OBJ_Abs_Lat_Acc: single
  OBJ_Abs_Lat_Acc_STD: single
  OBJ_Inv_TTC: single
  OBJ_Inv_TTC_STD: single
  OBJ_Object_Age: single
  OBJ_Measuring_Status: single
  OBJ_Object_Class: single
  OBJ_Class_Probability: single
  OBJ_Long_Distance: single
  OBJ_Long_Distance_STD: single
  OBJ_Lat_Distance: single
  OBJ_Lat_Distance_STD: single
  OBJ_Absolute_Speed: single
  OBJ_Heading: single
  OBJ_Angle_Mid_V: single
  OBJ_Angle_Mid: single
  OBJ_Angle_Mid_STD: single
  OBJ_Angle_Mid_STD_V: single

ROAD_EDGE_ST = Simulink.Bus()
  LRE_Age: single
  LRE_ExistProb: single
  LRE_Type: single
  LRE_ID: single
  LRE_LineC0: single
  LRE_LineC1: single
  LRE_LineC2: single
  LRE_LineC3: single
  LRE_Start: single
  LRE_End: single
  LRE_Side: single
  LRE_Height: single
  LRE_Height_STD: single
  LRE_Index: single

ROADEDGE_DATA_ST = Simulink.Bus()
  RoadEdgeProtHeader: Bus: ROAD_EDGE_ST
  RoadEdgeProtA: Bus: ROAD_EDGE_ST
  RoadEdgeProtB: Bus: ROAD_EDGE_ST
  RoadEdgeProtC: Bus: ROAD_EDGE_ST

EYEQ4_DATA_RT_ST = Simulink.Bus()
  LANE_DATA_ST: Bus: LANE_ST
  ROADEDGE_ST: Bus: ROADEDGE_DATA_ST
  OBJ_FRAME_INFO: Bus: OBJECT_FRAME_INFO
  OBJ_BUS: Bus: OBJECT_ST[40]

Host_Prot = Simulink.Bus()
  LH_Line_First_C0: single
  LH_Line_First_C1: single
  LH_Line_First_C2: single
  LH_Line_First_C3: single
  LH_side: single
  LH_Existence_Probability: single
  LH_First_VR_End: single
  LH_First_VR_Start: single
  LH_Lanemark_Type: single
  LH_Lanemark_Type_Conf: single
  LH_Marker_Width: single
  LH_Marker_Width_STD: single
  LH_Track_ID: single
  LH_Color: single
  LH_DLM_Type: single

Adja_Prot = Simulink.Bus()
  LA_Line_C0: single
  LA_Line_C1: single
  LA_Line_C2: single
  LA_Line_C3: single
  LA_Exist_Probability: single
  LA_Lane_Track_ID: single
  LA_Lanemark_Type: single
  LA_Lanemark_Type_Conf: single
  LA_Line_Role: single
  LA_Marker_Width: single
  LA_Marker_Width_STD: single
  LA_View_Range_End: single
  LA_View_Range_Start: single
  LA_Age: single
  LA_Color: single
  LA_Color_Conf: single
  LA_DLM_Type: single

LANE_ST = Simulink.Bus()
  Host_Prot_Header: Bus: Host_Prot_Header
  Host_Prot: Bus: Host_Prot[2]
  Adja_Prot: Bus: Adja_Prot[4]

Host_Prot_Header = Simulink.Bus()
  LH_Sync_ID: single
  LH_Lanes_Count: single
  LH_Estimated_Width: single
  LH_Sonw_On_Road_Prob: single