% Simulink data dictionary Func_Global_ACC.sldd
% references ARS308_RX.sldd
% references ZOP_Global.sldd

x1E5 = Simulink.Bus()
  StrgWhlAngGrd: single
  StrgWhlAng: single
  StrgWhlAngSnsrFlt: boolean
  StrgWhlAngSnsrMultCapb: boolean
  StrgWhlAngSnsrInid: boolean
  StrgWhlAngSnsrCalSts: single
  StrgWhlAngV: boolean

x194 = Simulink.Bus()
  TrShftLvrPos: single
  TrShftLvrPosV: boolean
  TrEstdGear: single
  TrEstdGearV: boolean

x185 = Simulink.Bus()
  VSELatAcc: single
  VSELongtAcc: single
  VSELongtAccV: boolean
  VSELatAccV: boolean

x1E9 = Simulink.Bus()
  VehDynYawRate: single
  VehDynYawRateV: boolean
  EnDragToqRducnA: boolean
  ABSA: boolean

x23C = Simulink.Bus()
  VehSpdAvg: single
  VehSpdAvgV: boolean

x24C = Simulink.Bus()
  WhlGndVelLDrvn_Radar: single
  WhlGndVelRDrvn_Radar: single
  BrkPdlDrvrAppdPrs_Radar: single
  LDrvnWhlRotlDircn: single
  RDrvnWhlRotlDircn: single
  WhlGndVelLDrvnV_Radar: boolean
  WhlGndVelRDrvnV_Radar: boolean
  WhlBrkPrsSts: boolean
  BrkDiscTemSts: boolean
  BrkPdlDrvrAppdPrsV_Radar: boolean

x24E = Simulink.Bus()
  WhlGndVelLNonDrvn_Radar: single
  WhlGndVelRNonDrvn_Radar: single
  WhlGndVelLNonDrvnV_Radar: boolean
  WhlGndVelRNonDrvnV_Radar: boolean
  LNonDrvnWhlRotlDircn_Radar: single
  TCSOpngMd_Radar: single
  TCSOpngSts_Radar: single
  RNonDrvnWhlRotlDircn_Radar: single
  VSEMd_Radar: single
  VSESts_Radar: single

x1E1 = Simulink.Bus()
  CCSwStsDistDecSwA: boolean
  CCSwStsDistIncSwA: boolean
  CCSwStsSpdDecSwA: boolean
  CCSwStsSpdIncSwA: boolean
  CCSwStsSetSwA: boolean
  CCSwStsRsmSwA: boolean
  CCSwStsOnSwA: boolean
  CCSwStsCanclSwA: boolean

COM_VehBus_st = Simulink.Signal(DataType="Bus: COM_VEHBUS_ST")

xAF = Simulink.Bus()
  EPTAccelActuPosV: boolean
  EPTBrkPdlDscrtInptSts: boolean
  EPTBrkPdlDscrtInptStsV: boolean
  EPTStCmdOn: boolean
  EPTAccelActuPos: single

xFB = Simulink.Bus()
  AccelOvrd: boolean
  PtACCToqReqResp: single

xAC = Simulink.Bus()
  EPTTrInptShaftMaxAvlblToq: single
  EPTTrInptShaftMinAvlblToq: single
  EPTTrInptShaftMaxAvlblToqV: boolean
  EPTTrInptShaftMinAvlblToqV: boolean

COM_x165_st = Simulink.Signal(DataType="Bus: x165")
COM_x242_st = Simulink.Signal(DataType="Bus: x242")
COM_x246_st = Simulink.Signal(DataType="Bus: x246")

x165 = Simulink.Bus()
  ACCToqReqStsHSC2: boolean
  ACCToqReqValHSC2: single

x242 = Simulink.Bus()
  ACCAccReqValTolMinHSC2: single
  ACCSdslReq_RadarHSC2: boolean
  ACCSysFltSts_SCSHSC2: single
  ACCGoReqHSC2: boolean
  ACCAccReqValTolMaxHSC2: single
  ACCAccReqValHSC2: single
  ACCAccReqStsHSC2: boolean
  ACCSysSts_RadarHSC2: single
  ChACCShtdwnMdHSC2: single
  ACCReqBrkPrfrdHSC2: boolean
  ACCMinBrkReqStsHSC2: boolean

x246 = Simulink.Bus()
  RdrCalPrgsReqHSC2: single
  FCWSysFltSts_RadarHSC2: single
  FCWSnstvtLvl_RadarHSC2: single
  FCWrnngSts_RadarHSC2: single
  FCWDspCmd_RadarHSC2: single
  AEBPedtrnDspCmdHSC2: single
  AEBMsgReqHSC2: single
  AEBDspCmd_RadarHSC2: single
  ACCSysFltSts_RadarHSC2: single
  ACCSysCanclReq_RadarHSC2: single
  ACCObjDet_RadarHSC2: boolean
  ACCMsgReqHSC2: single
  ACCGoNotfr_RadarHSC2: boolean
  ACCDrvrTkovReqHSC2: boolean
  ACCDrvrSelTrgtSpd_RadarHSC2: single
  ACCDrvrSeldTrgtDistLvl_RadarHSC2: single
  ACCDetObjDistLvl_RadarHSC2: single

ACC_LgtCtrl_st = Simulink.Signal(DataType="Bus: ACC_LGTCTRL_ST")
COM_PropAct_st = Simulink.Signal(DataType="Bus: COM_PROPACT_ST")

COM_PROPACT_ST = Simulink.Bus()
  MMotAct: single
  MMotMax: single
  MMotMin: single
  BrakeForce: boolean

COM_VehDyn_st = Simulink.Signal(DataType="Bus: COM_VEHDYN_ST")

COM_VEHDYN_ST = Simulink.Bus()
  AxSensor: single
  YrsSensor: single
  SasSensor: single
  WhlSpd_FL: single
  WhlSpd_FL_Valid: boolean
  WhlSpd_FR: single
  WhlSpd_FR_Valid: boolean
  WhlSpd_RL: single
  WhlSpd_RL_Valid: boolean
  WhlSpd_RR: single
  WhlSpd_RR_Valid: boolean
  AxSensor_Valid: boolean
  YrsSensor_Valid: boolean
  SasSensor_Valid: boolean

NET_DrvAction_st = Simulink.Signal(DataType="Bus: NET_DRVACTION_ST")

OBJDATA_ST = Simulink.Bus()
  Hist: boolean
  Valid: boolean
  dx: single
  dvarX: single
  dy: single
  dvarY: single
  vx: single
  vy: single
  ax: single
  ay: single
  MotionSts: single
  Type: single
  probExist: single
  ID: single

SYS_Info_st = Simulink.Signal(DataType="Bus: SYS_INFO_ST")

SYS_INFO_ST = Simulink.Bus()
  dT: single

VLC_LgtCmd_st = Simulink.Signal(DataType="Bus: VLC_LGTCMD_ST")

VLC_LGTCMD_ST = Simulink.Bus()
  EngineTorqReq: single
  EngineTorqReqSt: boolean
  ACCState: single
  CDDEnable: boolean
  CDDAxtar: single
  CDDDriveoffReq: boolean
  CDDStandstillReq: boolean

VSI_VehState_st = Simulink.Signal(DataType="Bus: VSI_VEHSTATE_ST")

VSI_VEHSTATE_ST = Simulink.Bus()
  YrsF: single
  AxSensorF: single
  StWheelAngleF: single
  vRef: single
  aRef: single
  AxSlope: single
  AxSlopeValid: boolean
  Curvature: single

x1B6 = Simulink.Bus()
  BrkPdlAppdV: single
  BrkPdlAppd: boolean

Radar410_Info_ST = Simulink.Bus()
  x50_20_Obj_00: Bus: Obj_Data
  x51_21_Obj_01: Bus: Obj_Data
  x52_22_Obj_02: Bus: Obj_Data
  x53_23_Obj_03: Bus: Obj_Data
  x54_24_Obj_04: Bus: Obj_Data
  x55_25_Obj_05: Bus: Obj_Data
  x56_26_Obj_06: Bus: Obj_Data
  x57_27_Obj_07: Bus: Obj_Data
  x58_28_Obj_08: Bus: Obj_Data
  x59_29_Obj_09: Bus: Obj_Data
  x5A_2A_Obj_10: Bus: Obj_Data
  x5B_2B_Obj_11: Bus: Obj_Data
  x5C_2C_Obj_12: Bus: Obj_Data
  x5D_2D_Obj_13: Bus: Obj_Data
  x5E_2E_Obj_14: Bus: Obj_Data
  x5F_2F_Obj_15: Bus: Obj_Data
  x60_30_Obj_16: Bus: Obj_Data
  x61_31_Obj_17: Bus: Obj_Data
  x62_32_Obj_18: Bus: Obj_Data
  x63_33_Obj_19: Bus: Obj_Data
  x64_34_Obj_20: Bus: Obj_Data
  x65_35_Obj_21: Bus: Obj_Data
  x66_36_Obj_22: Bus: Obj_Data
  x67_37_Obj_23: Bus: Obj_Data
  x68_38_Obj_24: Bus: Obj_Data
  x69_39_Obj_25: Bus: Obj_Data
  x6A_3A_Obj_26: Bus: Obj_Data
  x6B_3B_Obj_27: Bus: Obj_Data
  x6C_3C_Obj_28: Bus: Obj_Data
  x6D_3D_Obj_29: Bus: Obj_Data
  x6E_3E_Obj_30: Bus: Obj_Data
  x6F_3F_Obj_31: Bus: Obj_Data
  x70_40_Obj_32: Bus: Obj_Data
  x71_41_Obj_33: Bus: Obj_Data
  x72_42_Obj_34: Bus: Obj_Data
  x73_43_Obj_35: Bus: Obj_Data
  x74_44_Obj_36: Bus: Obj_Data
  x75_45_Obj_37: Bus: Obj_Data
  x76_46_Obj_38: Bus: Obj_Data
  x77_47_Obj_39: Bus: Obj_Data
  x80_Status: Bus: Radar_Status

Radar_Status = Simulink.Bus()
  Msg_CheckSum: single  % Check sum shall be generated out of each message content. check sum generation logic is TBC.
  Msg_AliveCounter: single  % Alive counter shall be incremented every radar sensor measurement cycle.
  Status_MisAlign: single  % This signal indicates radar sensor mis-alignment status.
    % 0x00:unknown
    % 0x01:calibrated
    % 0x02:sensor mis-alignment detected
    % 0x03:calibration in progress
    % 0x04:uncalibratable
    % 0x05-07:  reserved
  Status_HWErr: single  % Flag to indicate if HW is failed or not.
    % 0x0:HW is NOT failed
    % 0x1:HW is failed
  Status_BlkProg: single  % Sensor blockage status indication.
    % 0x0: FRS is NOT blocked
    % 0x1: FRS is blocked
  Fail: single  % This signal indicates if radar is working or not.
    % 0x0 = FRS radar is NOT working
    % 0x1 = FRS radar is working
  MeasEnabled: single  % This signal indicates if the radar sensor is performing measurement or not. (radio-wave emission or not) Since Conti does not have this, it could be setup as the same as FRS_Fail.
  Host_Yaw: single  % Host vehicle yaw rate in deg/s which is used for radar object tracking (calibrated host yaw rate if sensor has calibration capability).
    % Left turn is defined as FRS_Host_Yaw positive direction.
  HostSpeed: single  % Host vehicle over-ground speed which is used for radar object tracking (calibrated host velocity if the sensor has calibaration capability).
    % Forward movement is defined as FRS_HostSpeed positive direction.
  TimeStamp: single  % Sensor internal time stamp since the last sensor start up. the time stamp shall loop as it overflows.
  Latency: single  % Radar process latency in ms from radio-wave reflection observation to CAN message transmission for current cycle.

Obj_Data = Simulink.Bus()  % It includes all the infomation of the object from Radar.
  Msg_CheckSum1: single  % Check sum shall be generated out of each message content. check sum generation logic is TBC.
  Msg_AliveCounter1: single  % Alive counter shall be incremented every radar sensor measurement cycle.
  Obj_ExstProb: single  % Estimated existence probability of the object.
  Obj_XVelRel_Stdev: single  % Estimated 3-sigma standard deviation value of the relative longitudinal velocity of the object.
  Obj_XAccRel: single  % Relative longitudinal acceleration of the object
  Obj_ObstacleProb: single  % Estimated probability of the object being an obstacle.
  Obj_MotionPattern: single  % Motion type of object.
    % 0x00: Unknown
    % 0x01: Stationary
    % 0x02: Stopped
    % 0x03: Moving
    % 0x04: Crossing
    % 0x05-07: reserved
  Obj_YPos_Stdev: single  % Estimated 3-sigma standard deviation value of lateral position of the object.
  Obj_ValidFlag: single  % Validity indication flag. when this value shows invalid, all the signals in the corresponding CAN messages except FRS_Msg_AliveCounter and FRS_Msg_CheckSum shall take default values.
    % 0x0: Object invalid
    % 0x1: Object valid
  Obj_XPos_Stdev: single  % Estimated 3-sigma standard deviation value of longitudinal position of the object.
  Obj_UpdateFlag: single  % Flag to indicate newly created object in CAN bus.
    % Object history flag
    % 0x0: new object in the cycle;
    % 0x1: object existed in previous cycle
  Obj_ID: single  % ID is defined as a unique identification number over the lifetime of the object.
    % 0xFF: Invalid
    % 0x00 - 0xFE: Valid
  Msg_CheckSum2: single  % Check sum shall be generated out of each message content. check sum generation logic is TBC.
  Msg_AliveCounter2: single  % Alive counter shall be incremented every radar sensor measurement cycle.
  Obj_MeasFlag: single  % This signal indicates whether the latest sensor measurement observed the object or extrapolated.
    % 0x0: object measured in this cycle
    % 0x1: object extrapolated in this cycle
  Obj_YVelRel: single  % Relative lateral velocity of the object
  Obj_Type: single  % To indicate the estimated type of Object
    % 0x00: Unknown
    % 0x01: 4 wheeler
    % 0x02: 2 wheeler
    % 0x03: Pedestrian
  Obj_XPos: single  % Position of target object in longitudinal direction
    % center of vehicle rear axle shaft is reference point.
  Obj_YPos: single  % Position of target object in lateral direction
    % center of vehicle rear axle shaft is reference point.
  Obj_XVelRel: single  % Relative longitudinal velocity of the object.

ATS_Po_st = Simulink.Signal(DataType="Bus: ATS_PO_ST")

x46A = Simulink.Bus()
  DircnIndLampSwSts: single

x376 = Simulink.Bus()
  LDWLKASwReq: single

x1EC = Simulink.Bus()
  ChLKACtrlSts: single
  DrvrStrgDlvrdToqV: boolean
  DrvrStrgDlvrdToq: single
  ChLKARespToq: single
  ChLKARespToqV: boolean

x255 = Simulink.Bus()
  Vehicle_Front_dy: single
  Vehicle_Front_dx: single
  Vehicle_Front_Type: single
  ACC_Tip: single
  ACC_Status: single
  ACC_Passive_Rea: single
  ACC_Error: single
  TimeGapRes: single
  vSetDis: single

x251 = Simulink.Bus()
  VehTrgtLongtAcc: single
  ChAEBDclReqResp: single
  ChACCAEBBrkJerkReqResp: single
  ChAEBPrflReqResp: single
  ChACCReqFlrSts: single
  ChAEBHydBrkAstReqResp: single
  ChACCAccReqResp: single
  VehSdslSts: single

x19C = Simulink.Bus()
  EPTTrInptShaftSpd: single
  EPTTrInptShaftToq: single
  EPTTrInptShaftSpdV: boolean
  EPTTrInptShaftToqV: boolean

COM_VEHBUS_ST = Simulink.Bus()
  x194: Bus: x194
  xFB: Bus: xFB
  x1E1: Bus: x1E1
  x1E5: Bus: x1E5
  x185: Bus: x185
  x1E9: Bus: x1E9
  x23C: Bus: x23C
  x24C: Bus: x24C
  x24E: Bus: x24E
  xAF: Bus: xAF
  xAC: Bus: xAC
  x1B6: Bus: x1B6
  x46A: Bus: x46A
  x376: Bus: x376
  x1EC: Bus: x1EC
  x251: Bus: x251
  x19C: Bus: x19C

ATS_PO_ST = Simulink.Bus()
  Valid: boolean
  Index: single
  dx: single
  dy: single
  vx: single
  vy: single
  ax: single
  vxAbs: single
  axAbs: single
  Type: single
  MotionSts: single

NET_DRVACTION_ST = Simulink.Bus()
  BrakePedalApply: boolean
  DrvOverride: boolean
  ACC_MainSw: boolean
  ACC_CancelSw: boolean
  ACC_SetSw: boolean
  ACC_SetSwK1: boolean
  ACC_ResSw: boolean
  ACC_SpdIncSw: boolean
  ACC_SpdIncSwK1: boolean
  ACC_SpdDecSw: boolean
  ACC_SpdDecSwK1: boolean
  ACC_DistIncSw: boolean
  ACC_DistDecSw: boolean
  GearLever: single

FUS_LANE_DATA_ST = Simulink.Bus()
  id: uint8  % The obj id.The id number needs to be equal to the index in the object stucture
  traceStatus: uint8  % 0:invalid,
    % 1:init,
    % 2:measurement,
    % 3:predicted
  quality: uint8  % 0:Low,
    % 1:Mid,
    % 2:Mid high
    % 3:High
  color: uint8  % 0:unknown,
    % 1:white,
    % 2:yellow,
    % 3:blue
  type: uint32  % 0: None,
    % 1: Solid,
    % 2: Dashed,
    % 3: Solid Dashed
    % 4: Dashed Solid
    % 5: Double(Left Dased, Right Solid)
    % 6: Double(Left Solid, Right Dased)
    % 7: Double(Double Dashed)
    % 8: Double(Double Solid)
    % 9: Botts Dots
    % 10: Invalid
    % 11: Undecided
  width: single  % total width of lane marker, from inner edge to outer edge
  curFunction: Bus: FUS_LANE_TRACK_EST_ST  % fusion lane marker curve function

FUS_LANE_OUTPUT_ST = Simulink.Bus()
  timestamp: double
  frameNum: uint32
  hostLaneWidth: single  % host lane width
  leftLaneWidth: single
  rightLaneWidth: single
  leftHostLane: Bus: FUS_LANE_DATA_ST
  rightHostLane: Bus: FUS_LANE_DATA_ST
  leftNeighborLane: Bus: FUS_LANE_DATA_ST
  rightNeighborLane: Bus: FUS_LANE_DATA_ST
  primaryObjTrajectory: Bus: FUS_LANE_PRIMARY_TRA
  laneChangeStatus: uint32  % 0:No lane change,
    % 1:Lane change to the left,
    % 2:Lane change to the right

FUS_LANE_PRIMARY_TRA = Simulink.Bus()
  id: uint8
  traceStatus: uint8  % 0 invalid
    % 1 init
    % 2 measurement
    % 3 predicted
  quality: uint8  % 0 invalid
    % 1 low
    % 2 mid
    % 3 mid high
    % 4 high
  curveFunc: Bus: FUS_LANE_TRACK_EST_ST

FUS_LANE_START_POINT = Simulink.Bus()
  x0: single
  y0: single

FUS_LANE_TRACK_EST_ST = Simulink.Bus()  % descripton of a curve as function f(x)= a + bx + cx^2 +dx^3 this structure defines the coefficient of the curve function
  latDistanceZeroOrderCoeff: single  % coefficient a
  latDistanceFirstOrderCoeff: single  % coefficient b
  latDistanceSecondOrderCoeff: single  % coefficient c
  latDistanceThirdOrderCoeff: single  % coefficient d
  longDistanceToend: single  % end of the curve
  startPoint: Bus: FUS_LANE_START_POINT

FUS_OBJ_DATA_ST = Simulink.Bus()  % fusion object data
  obj_estimate: Bus: FUS_OBJ_TRACK_EST_ST
  obj_property: Bus: FUS_OBJ_TRACK_PROP_ST
  obj_information: Bus: FUS_OBJ_TRACK_INFO_ST

FUS_OBJ_OUTPUT_ST = Simulink.Bus()
  timeStamp: double  % Common timestamp for all object and barrier signals
  objects: Bus: FUS_OBJ_DATA_ST[40]  % fusion obj
  frameNum: uint32  % frame nmber

FUS_OBJ_TRACK_EST_ST = Simulink.Bus()  % fusion object estimate
  longPosition: single  % The longitudinal distance to the middle of nearest facing side of the object.Measured in the reference coordinate system
  latPosition: single  % The lateral distance to the middle of nearest facing side of the object.Measured in the reference coordinate system
  headingAngle: single  % The heading angle for a vechile.It is defined as the angle between the heading of the detected vehicle and the heading of the host vehicle.
  speed: single  % The vehicle speed relative to the ground and in direction of the vehicle traveling
  yawRate: single  % The yawRate of the object in the reference coordinate system
  longRelativeVelocity: single  % The longitudinal relative velocity of the object in the reference coordinate system.
  latRelativeVelocity: single  % The lateral relative velocity of the object in the reference coordinate system.
  longAbsoluteVelocity: single  % The longitudinal absolute velocity of the object in the reference coordinate system.
  latAbsoluteVelocity: single  % The lateral absolute velocity of the object in the reference coordinate system.
  acceleration: single  % The vehicle acceleration relative to the ground and in direction of the vehicle traveling
  longRelativeAcceleration: single  % The longitudinal relative acceleration of the object in the reference coordinate system.
  latRelativeAcceleration: single  % The lateral relative acceleration of the object in the reference coordinate system.
  longAbsoluteAcceleration: single  % The longitudinal absolute acceleration of the object in the reference coordinate system.
  latAbsoluteAcceleration: single  % The lateral absolute acceleration of the object in the reference coordinate system.
  curvature: single  % the curvature of the object trajectory

FUS_OBJ_TRACK_INFO_ST = Simulink.Bus()  % fusion object information
  valid: uint8  % the valid of fusion obj.
    % 0: invalid;
    % 1: valid
  type: uint8  % Fusion Object classification
    % 0: Unknown
    % 1: Pedestrian
    % 2: Cyclist
    % 3: Bus
    % 4: Small_Medium_Car
    % 5: Trucks
    % 6: Tri-Motor
    % 7: Special_vehicle
    % 8: Tiny_car
    % 9: Ambulance
    % 10: UncertainVehicle
  nearestSide: uint8  % which object side that is nearest (facing) the host vehicle
    % 0: Rear
    % 1: Front
    % 2: Right
    % 3: Left
    % 4: Unknown
  motionPatternCurrent: uint8  % 0:unknown,
    % 1:stationary,
    % 2:driving,
    % 3:oncoming,
    % 4:driving stopped
    % 5:oncoming stopped
  motionPatternHistory: uint8  % 0:unknown,1:stopped,2:recedable,3:oncomeable
  width: single  % The object width
    % The width is the extent of the nearest facing side
  height: single  % The object height.
  length: single  % The object length.
  distanceToleftNearLaneMarking: single  % The lateral distance between the object and the closest lane marking to the left
  distanceToRightNearLaneMarking: single  % The lateral distance between the object and the closest lane marking to the right

FUS_OBJ_TRACK_PROP_ST = Simulink.Bus()  % fusion object property
  id: uint8  % The obj id.The id number needs to be equal to the index in the object stucture
  fusionSource: uint8  % fusionSource：
    % 0: vision only
    % 1: radar only
    % 2: fused radar vision
    % 255: unkown
  motionModel: uint8  % The motion model used for the object.
    % Fusion motion model：
    % 0: CA
    % 1: CTRA
    % 255: unkown
  trackStatus: uint8  % Fusion obj trace status:
    % 0: New(Initialized),
    % 1: Measured,
    % 2: Predicted,
  positionConfidence: uint8  % Position confidence(Used in RoadGeometryFusion).
    % 0:Not Reliable
    % 1:Reliable
  fcwConfidence: uint8  % The object confidence for function FCW.0:Not Reliable,1:Warning reliable
  tjaConfidence: uint8  % The object confidence for function TJA.0:Not Reliable,1:Reliable 1:Reliable
  leftNearLaneMarkingConfidence: uint8  % Left nearest lane marking confidence.Not Reliable
  rightNearLaneMarkingConfidence: uint8  % Right nearest lane marking confidence.0:Not reliable,1:Reliable
  visionId: uint8  % The vision id for the object.Note!The vision id number do not need to be equal to the index in the object structure
  accelerationStdDev: single  % Standard deviation for object acceleration
  headingAngleStdDev: single  % Standard deviation for the heading angle of the object
  latPositionStdDev: single  % Standard deviation for the lateral position of the object
  longPositionStdDev: single  % standard deviation for longitudinal position of the object
  speedStdDev: single  % Standard deviation for object speed

FUS_ObjData_st = Simulink.Signal(DataType="Bus: FUS_OBJDATA_ST")

FUS_OBJDATA_ST = Simulink.Bus()
  timeStamp: double
  objdata_st: Bus: OBJDATA_ST[40]

FUS_ObjOutput_st = Simulink.Signal(DataType="Bus: FUS_OBJ_OUTPUT_ST")

FUS_ROAD_EDGE_DATA_ST = Simulink.Bus()
  quality: uint8  % 0:invalid,
    % 1:Low,
    % 2:Mid,
    % 3:Mid High,
    % 4:High
  reserved: uint8
  type: uint16  % 0: Unknown
    % 1: Lawn
    % 2: Sand
    % 3: Stone
    % 4: Wall
    % 5: Fence
    % 6: Curb
    % 7: Cone Bucket
    % 8: Parked Car
    % 9: Snow
  id: uint32
  trackStatus: uint32  % 0:invalid,
    % 1:init,
    % 2:measurement,
    % 3:predicted
  roadEdgeCurve: Bus: FUS_LANE_TRACK_EST_ST

FUS_ROAD_EDGE_OUTPUT_ST = Simulink.Bus()
  timestamp: double  % Common timestamp for all object and barrier signals
  frameNum: uint32
  hostVehPos: uint32  % 0 unkonwn
    % 1 left
    % 2 mid
    % 3 right
  leftRoadEdge: Bus: FUS_ROAD_EDGE_DATA_ST
  rightRoadEdge: Bus: FUS_ROAD_EDGE_DATA_ST
  errorFlag: uint8
  detectedEdgeCnt: uint8  % the count of road edge to be detected on image

ACC_LGTCTRL_ST = Simulink.Bus()
  ACCCMDType: uint8
  ACCVLCMainReq: single
  ACCAxtar: single
  ACCAxTarUpperComfBand: single
  ACCAxTarLowerComfBand: single
  ACCBrkPrfrd: boolean
  ACCDriveoffReq: boolean
  ACCStandstillReq: boolean
  ACCdSet: single
  ACCvSet: single
  ACC_Disable_Msk: uint16