% Simulink data dictionary LCK_CtrlPara.sldd

k_LCK_A0Fac_ActSta = Simulink.Parameter(repmat(1, 1, 7), StorageClass="ExportedGlobal", DataType="single")
k_LCK_A0Fac_DrvStm = Simulink.Parameter([0.7 0.8 0.9 1 1 1 1], StorageClass="ExportedGlobal", DataType="single")
k_LCK_A0Shift_LftCurv = Simulink.Parameter([0.1 0.1 0.1 0.1 0.1 0.1 0.1 0.1 0.2 0.2 0.2 0.2 0.2 0], StorageClass="ExportedGlobal", DataType="single")
k_LCK_A0Shift_RgtCurv = Simulink.Parameter([-0.05 -0.05 -0.05 -0.05 -0.05 -0.05 -0.05 -0.05 -0.05 -0.05 -0.05 -0.05 -0.05 0], StorageClass="ExportedGlobal", DataType="single")
k_LCK_A0Shift_StraLan = Simulink.Parameter(0, StorageClass="ExportedGlobal", DataType="single")
k_LCK_A0ShiftFac_Dy_LftCurv = Simulink.Parameter([0.5 0.5 0.5 0.5 0.5 0.5 0.5 0.5 0.5 0.5 1 1 1 1 1 1 1 1 1], StorageClass="ExportedGlobal", DataType="single")
k_LCK_A0ShiftFac_Dy_RgtCurv = Simulink.Parameter(repmat(1, 1, 19), StorageClass="ExportedGlobal", DataType="single")
k_LCK_A0ShiftFac_DyBks = Simulink.Parameter([0 0.05 0.1 0.2 0.3 0.4 0.5 0.6 0.8 1], StorageClass="ExportedGlobal", DataType="single")
k_LCK_A0ShiftFac_Vspd = Simulink.Parameter(repmat(1, 1, 16), StorageClass="ExportedGlobal", DataType="single")
k_LCK_CvatRateBks = Simulink.Parameter([-0.0001 -8.0e-5 -6.0e-5 -4.0e-5 -2.0e-5 -1.0e-5 -5.0e-6 0 5.0e-6 1.0e-5 2.0e-5 4.0e-5 6.0e-5 8.0e-5 0.0001], StorageClass="ExportedGlobal", DataType="single")
k_LCK_CvatrBks = Simulink.Parameter([0.0001 0.0001667 0.00025 0.0003333 0.0005 0.0006667 0.0008333 0.001 0.00125 0.00143 0.001667 0.002 0.0025 0.003333 0.005 0.01], StorageClass="ExportedGlobal", DataType="single")
k_LCK_DFac_Dy = Simulink.Parameter(repmat(1, 1, 10), StorageClass="ExportedGlobal", DataType="single")
k_LCK_DFac_Dy_Curv = Simulink.Parameter(repmat(1, 1, 10), StorageClass="ExportedGlobal", DataType="single")
k_LCK_DFac_Rad = Simulink.Parameter([0.55 0.55 0.55 0.55 0.55 0.6 0.65 0.7 0.75 0.8 0.85 0.9 1 1], StorageClass="ExportedGlobal", DataType="single")
k_LCK_DFac_SA_CurCen = Simulink.Parameter(repmat(1, 1, 8), StorageClass="ExportedGlobal", DataType="single")
k_LCK_DFac_SA_CurSid = Simulink.Parameter(repmat(1, 1, 8), StorageClass="ExportedGlobal", DataType="single")
k_LCK_DFac_SA_StrCen = Simulink.Parameter(repmat(1, 1, 8), StorageClass="ExportedGlobal", DataType="single")
k_LCK_DFac_SA_StrSid = Simulink.Parameter(repmat(1, 1, 8), StorageClass="ExportedGlobal", DataType="single")
k_LCK_DFac_SS_CurCen = Simulink.Parameter([1 0.9 0.7 0.5 0.4 0.3 0.3 0.3], StorageClass="ExportedGlobal", DataType="single")
k_LCK_DFac_SS_CurSid = Simulink.Parameter([1 1 0.7 0.6 0.4 0.35 0.3 0.3], StorageClass="ExportedGlobal", DataType="single")
k_LCK_DFac_SS_StrCen = Simulink.Parameter([1 1 0.8 0.6 0.4 0.2 0.1 0.05], StorageClass="ExportedGlobal", DataType="single")
k_LCK_DFac_SS_StrSid = Simulink.Parameter([1 0.9 0.7 0.5 0.4 0.2 0.1 0.05], StorageClass="ExportedGlobal", DataType="single")
k_LCK_DFac_Vspd = Simulink.Parameter([0 0 1 1 1 1 1 1 1 1.05 1.05 1.1 1.15 1.2 1.2 1.2], StorageClass="ExportedGlobal", DataType="single")
k_LCK_DlyTm_DrvStim = Simulink.Parameter(0.2, StorageClass="ExportedGlobal", DataType="single")
k_LCK_DTermMax = Simulink.Parameter(2, StorageClass="ExportedGlobal", DataType="single")
k_LCK_Dy_VehInCurvLanCentLowLmt = Simulink.Parameter(0.25, StorageClass="ExportedGlobal", DataType="single")
k_LCK_Dy_VehInCurvLanCentUpLmt = Simulink.Parameter(0.35, StorageClass="ExportedGlobal", DataType="single")
k_LCK_Dy_VehInStraLanCentLowLmt = Simulink.Parameter(0.2, StorageClass="ExportedGlobal", DataType="single")
k_LCK_Dy_VehInStraLanCentUpLmt = Simulink.Parameter(0.3, StorageClass="ExportedGlobal", DataType="single")
k_LCK_DyBks_Curv = Simulink.Parameter([-1 -0.8 -0.6 -0.5 -0.4 -0.3 -0.2 -0.1 -0.05 0 0.05 0.1 0.2 0.3 0.4 0.5 0.6 0.8 1], StorageClass="ExportedGlobal", DataType="single")
k_LCK_Fac_Vspd2RngThr_FalRec = Simulink.Parameter(0.23, StorageClass="ExportedGlobal", DataType="single")
k_LCK_Ffw_CvatSwh = Simulink.Parameter(0, StorageClass="ExportedGlobal", DataType="single")
k_LCK_Ffw_DyBks = Simulink.Parameter([0.05 0.1 0.15 0.2 0.3 0.4 0.5 0.7], StorageClass="ExportedGlobal", DataType="single")
k_LCK_Ffw_MaxTorqCmd = Simulink.Parameter(3, StorageClass="ExportedGlobal", DataType="single")
k_LCK_Ffw_TimCon_CmdFlt = Simulink.Parameter(0, StorageClass="ExportedGlobal", DataType="single")
k_LCK_FfwDeltaFac_Rad_Lft = Simulink.Parameter(repmat(1, 1, 14), StorageClass="ExportedGlobal", DataType="single")
k_LCK_FfwDeltaFac_Rad_Rgt = Simulink.Parameter(repmat(1, 1, 14), StorageClass="ExportedGlobal", DataType="single")
k_LCK_FfwDeltaFac_Vspd = Simulink.Parameter([0 0.5 0.5 0.5 0.5 0.5 0.5 0.6 1 1 1 1 1 1 1 1], StorageClass="ExportedGlobal", DataType="single")
k_LCK_FfwFac_CvatRate_Lft = Simulink.Parameter([1.05 1.05 1.05 1.05 1.05 1.05 1.02 1 0.95 0.9 0.8 0.8 0.8 0.8 0.8], StorageClass="ExportedGlobal", DataType="single")
k_LCK_FfwFac_CvatRate_Rgt = Simulink.Parameter([0.9 0.9 0.9 0.9 0.9 0.95 0.98 1 1.05 1.08 1.08 1.1 1.1 1.1 1.1], StorageClass="ExportedGlobal", DataType="single")
k_LCK_FfwFac_Dy = Simulink.Parameter([0 0 0.05 0.05 0.07 0.1 0.15 0.15], StorageClass="ExportedGlobal", DataType="single")
k_LCK_FfwFac_Rad_Lft = Simulink.Parameter([1.3 1.2 1.1 1 1 1 1 1 0.9 0.95 0.95 0.95 0.95 0.95], StorageClass="ExportedGlobal", DataType="single")
k_LCK_FfwFac_Rad_Rgt = Simulink.Parameter([1.3 1.2 1.1 1 1 1 1 1 1 1 1 1 1 1], StorageClass="ExportedGlobal", DataType="single")
k_LCK_FfwFac_Vspd = Simulink.Parameter([0 0 0.35 0.35 0.4 0.5 0.6 0.7 0.85 1 1.1 1.3 1.4 1.5 1.6 1.6], StorageClass="ExportedGlobal", DataType="single")
k_LCK_HAFac_ActSta = Simulink.Parameter(repmat(1, 1, 7), StorageClass="ExportedGlobal", DataType="single")
k_LCK_HAFac_DrvStm = Simulink.Parameter([0.7 0.8 0.9 1 1 1 1], StorageClass="ExportedGlobal", DataType="single")
k_LCK_HARFac_ActSta = Simulink.Parameter(repmat(1, 1, 7), StorageClass="ExportedGlobal", DataType="single")
k_LCK_HARFac_DrvStm = Simulink.Parameter([0.7 0.8 0.9 1 1 1 1], StorageClass="ExportedGlobal", DataType="single")
k_LCK_Hed_DyBks = Simulink.Parameter([0.05 0.1 0.15 0.2 0.3 0.4 0.5 0.7 0.9 1.1], StorageClass="ExportedGlobal", DataType="single")
k_LCK_HedAngDiffX = Simulink.Parameter([0 0.1 0.2 0.3 0.4 0.6 0.8 1 2 3], StorageClass="ExportedGlobal", DataType="single")
k_LCK_HedAngRateDiffX = Simulink.Parameter([0 0.1 0.2 0.3 0.4 0.6 0.8 1 2 3], StorageClass="ExportedGlobal", DataType="single")
k_LCK_HedAngRateSlopeLmt = Simulink.Parameter(10, StorageClass="ExportedGlobal", DataType="single")
k_LCK_KpKdDecSlopeLmt = Simulink.Parameter(10, StorageClass="ExportedGlobal", DataType="single")
k_LCK_KpKdIncSlopeLmt = Simulink.Parameter(5, StorageClass="ExportedGlobal", DataType="single")
k_LCK_Lat_Ctrl_DFac_Lft = Simulink.Parameter(1, StorageClass="ExportedGlobal", DataType="single")
k_LCK_Lat_Ctrl_DFac_Rgt = Simulink.Parameter(1.05, StorageClass="ExportedGlobal", DataType="single")
k_LCK_Lat_Ctrl_Kd = Simulink.Parameter(0.8, StorageClass="ExportedGlobal", DataType="single")
k_LCK_Lat_Ctrl_Ki = Simulink.Parameter(0.5, StorageClass="ExportedGlobal", DataType="single")
k_LCK_Lat_Ctrl_Kp = Simulink.Parameter(0.7, StorageClass="ExportedGlobal", DataType="single")
k_LCK_Lat_Ctrl_PFac_Lft = Simulink.Parameter(1, StorageClass="ExportedGlobal", DataType="single")
k_LCK_Lat_Ctrl_PFac_Rgt = Simulink.Parameter(1.05, StorageClass="ExportedGlobal", DataType="single")
k_LCK_Lat_Ctrl_TimCon_CmdFlt = Simulink.Parameter(5, StorageClass="ExportedGlobal", DataType="single")
k_LCK_Lat_DFac_Rad = Simulink.Parameter([0.4 0.4 0.45 0.45 0.5 0.6 0.65 0.7 0.8 0.8 0.85 0.9 1 1], StorageClass="ExportedGlobal", DataType="single")
k_LCK_Lat_DFac_SS_Cur = Simulink.Parameter([1 0.9 0.7 0.5 0.4 0.3 0.2 0.15], StorageClass="ExportedGlobal", DataType="single")
k_LCK_Lat_DFac_SS_Str = Simulink.Parameter(repmat(1, 1, 8), StorageClass="ExportedGlobal", DataType="single")
k_LCK_Lat_DFac_Vspd = Simulink.Parameter([0 0 1 1 1 1 1 1 1 1.05 1.05 1.1 1.1 1.2 1.2 1.2], StorageClass="ExportedGlobal", DataType="single")
k_LCK_Lat_DyBks = Simulink.Parameter([0.05 0.1 0.2 0.3 0.4 0.5 0.6 0.8 1 1.2], StorageClass="ExportedGlobal", DataType="single")
k_LCK_Lat_IFac_Rad = Simulink.Parameter(repmat(1, 1, 14), StorageClass="ExportedGlobal", DataType="single")
k_LCK_Lat_IFac_Vspd = Simulink.Parameter([0 1 1 1 1 1 1 1 1 1 1 1 1 1 1 1], StorageClass="ExportedGlobal", DataType="single")
k_LCK_Lat_ILmtFac_Dy_CurvLan = Simulink.Parameter([0.8 0.8 1 1.2 1.2 1.2 1.2 1.2 1.2 1.2], StorageClass="ExportedGlobal", DataType="single")
k_LCK_Lat_ILmtFac_Dy_StraLan = Simulink.Parameter([1 1 1 1.5 1.5 1.5 1.5 1.5 1.5 1.5], StorageClass="ExportedGlobal", DataType="single")
k_LCK_Lat_ILmtFac_Rad = Simulink.Parameter([0 0 0.1 0.1 0.15 0.15 0.15 0.3 0.3 0.4 0.5 0.5 0.5 0.5], StorageClass="ExportedGlobal", DataType="single")
k_LCK_Lat_ILmtFac_Rad_NearGain = Simulink.Parameter(1, StorageClass="ExportedGlobal", DataType="single")
k_LCK_Lat_ILmtFac_Vspd_CurvLan = Simulink.Parameter([0 1 1 1 1 1 1 1 1 1 1 1 1 1 1 1], StorageClass="ExportedGlobal", DataType="single")
k_LCK_Lat_ILmtFac_Vspd_StraLan = Simulink.Parameter([0 1 1 1 1 1 1 1 1 1 0.8 0.8 0.8 0.8 0.8 0.8], StorageClass="ExportedGlobal", DataType="single")
k_LCK_Lat_ITermLmt_Dy = Simulink.Parameter(1, StorageClass="ExportedGlobal", DataType="single")
k_LCK_Lat_KpKdDecSlopeLmt = Simulink.Parameter(10, StorageClass="ExportedGlobal", DataType="single")
k_LCK_Lat_KpKdIncSlopeLmt = Simulink.Parameter(10, StorageClass="ExportedGlobal", DataType="single")
k_LCK_Lat_PFac_Dy_InnLftCur = Simulink.Parameter([1.1 1.1 1.1 1 1 0.9 0.6 0.5 0.45 0.3], StorageClass="ExportedGlobal", DataType="single")
k_LCK_Lat_PFac_Dy_InnRgtCur = Simulink.Parameter([1.1 1.1 1.1 1 0.9 0.7 0.6 0.4 0.4 0.3], StorageClass="ExportedGlobal", DataType="single")
k_LCK_Lat_PFac_Dy_OutLftCur = Simulink.Parameter([1 1 1 1 0.9 0.5 0.4 0.3 0.2 0.2], StorageClass="ExportedGlobal", DataType="single")
k_LCK_Lat_PFac_Dy_OutRgtCur = Simulink.Parameter([1 1 0.9 0.85 0.8 0.5 0.4 0.2 0.2 0.2], StorageClass="ExportedGlobal", DataType="single")
k_LCK_Lat_PFac_Dy_Str = Simulink.Parameter([1.1 1.1 1.1 1 1 0.8 0.6 0.5 0.4 0.3], StorageClass="ExportedGlobal", DataType="single")
k_LCK_Lat_PFac_Rad = Simulink.Parameter([0.4 0.4 0.45 0.45 0.5 0.6 0.65 0.7 0.8 0.8 0.85 0.9 1 1], StorageClass="ExportedGlobal", DataType="single")
k_LCK_Lat_PFac_SS_Cur = Simulink.Parameter([1 0.9 0.7 0.5 0.4 0.3 0.2 0.15], StorageClass="ExportedGlobal", DataType="single")
k_LCK_Lat_PFac_SS_Str = Simulink.Parameter(repmat(1, 1, 8), StorageClass="ExportedGlobal", DataType="single")
k_LCK_Lat_PFac_Vspd = Simulink.Parameter([0 0 1 1 1 1 1 1 1 1.05 1.05 1.1 1.1 1.2 1.2 1.2], StorageClass="ExportedGlobal", DataType="single")
k_LCK_Lat_PTermMax = Simulink.Parameter(2, StorageClass="ExportedGlobal", DataType="single")
k_LCK_LatCtrl_DFac_Lft = Simulink.Parameter(1, StorageClass="ExportedGlobal", DataType="single")
k_LCK_LatCtrl_DFac_Rgt = Simulink.Parameter(1.05, StorageClass="ExportedGlobal", DataType="single")
k_LCK_LatCtrl_PFac_Lft = Simulink.Parameter(1, StorageClass="ExportedGlobal", DataType="single")
k_LCK_LatCtrl_PFac_Rgt = Simulink.Parameter(1.05, StorageClass="ExportedGlobal", DataType="single")
k_LCK_LatCtrl_TimCon_CmdFlt = Simulink.Parameter(5, StorageClass="ExportedGlobal", DataType="single")
k_LCK_MaxTorqCmdLmt = Simulink.Parameter(3, StorageClass="ExportedGlobal", DataType="single")
k_LCK_NonLinCompFac_Vspd = Simulink.Parameter(repmat(1, 1, 16), StorageClass="ExportedGlobal", DataType="single")
k_LCK_NonLinCompTab = Simulink.Parameter([0 0.1 0.2 0.3 0.4 0.5 0.6 0.7 0.8 0.9 1 1.2 1.4 1.6 1.8 2 2.2 2.4 2.6 3], StorageClass="ExportedGlobal", DataType="single")
k_LCK_NonLinearComp_En = Simulink.Parameter(0, StorageClass="ExportedGlobal", DataType="single")
k_LCK_PFac_Dy = Simulink.Parameter(repmat(1, 1, 10), StorageClass="ExportedGlobal", DataType="single")
k_LCK_PFac_Dy_Curv = Simulink.Parameter(repmat(1, 1, 10), StorageClass="ExportedGlobal", DataType="single")
k_LCK_PFac_Rad = Simulink.Parameter([0.55 0.55 0.55 0.55 0.55 0.6 0.65 0.7 0.75 0.8 0.85 0.9 1 1], StorageClass="ExportedGlobal", DataType="single")
k_LCK_PFac_SA_CurCen = Simulink.Parameter(repmat(1, 1, 8), StorageClass="ExportedGlobal", DataType="single")
k_LCK_PFac_SA_CurSid = Simulink.Parameter(repmat(1, 1, 8), StorageClass="ExportedGlobal", DataType="single")
k_LCK_PFac_SA_StrCen = Simulink.Parameter(repmat(1, 1, 8), StorageClass="ExportedGlobal", DataType="single")
k_LCK_PFac_SA_StrSid = Simulink.Parameter(repmat(1, 1, 8), StorageClass="ExportedGlobal", DataType="single")
k_LCK_PFac_SS_CurCen = Simulink.Parameter([1 0.9 0.7 0.5 0.4 0.3 0.3 0.3], StorageClass="ExportedGlobal", DataType="single")
k_LCK_PFac_SS_CurSid = Simulink.Parameter([1 1 0.7 0.6 0.4 0.35 0.3 0.3], StorageClass="ExportedGlobal", DataType="single")
k_LCK_PFac_SS_StrCen = Simulink.Parameter([1 1 0.8 0.6 0.4 0.2 0.1 0.05], StorageClass="ExportedGlobal", DataType="single")
k_LCK_PFac_SS_StrSid = Simulink.Parameter([1 0.9 0.7 0.5 0.4 0.2 0.1 0.05], StorageClass="ExportedGlobal", DataType="single")
k_LCK_PreViewTim_Rad = Simulink.Parameter([0.4 0.4 0.5 0.5 0.5 0.6 0.6 0.6 0.7 0.7 0.7 0.8 0.8 1.2], StorageClass="ExportedGlobal", DataType="single")
k_LCK_PTermMax = Simulink.Parameter(2, StorageClass="ExportedGlobal", DataType="single")
k_LCK_RadBks = Simulink.Parameter([100 150 200 250 300 350 400 600 800 1000 1500 2000 3000 5000], StorageClass="ExportedGlobal", DataType="single")
k_LCK_RatLmt_TorqCmd = Simulink.Parameter(repmat(5, 1, 20), StorageClass="ExportedGlobal", DataType="single")
k_LCK_RatLmtFac_TorqCmd_Vspd = Simulink.Parameter(repmat(1, 1, 16), StorageClass="ExportedGlobal", DataType="single")
k_LCK_RmpDwnEn_FfwCmd = Simulink.Parameter(1, StorageClass="ExportedGlobal", DataType="single")
k_LCK_RmpDwnEn_TorqCmd = Simulink.Parameter(1, StorageClass="ExportedGlobal", DataType="single")
k_LCK_RmpUpEn_FfwCmd = Simulink.Parameter(1, StorageClass="ExportedGlobal", DataType="single")
k_LCK_RmpUpEn_TorqCmd = Simulink.Parameter(1, StorageClass="ExportedGlobal", DataType="single")
k_LCK_RngThr_FalRec = Simulink.Parameter([15 15 15 15 15 20 20 20 20 20 25 25 25 25 25 25], StorageClass="ExportedGlobal", DataType="single")
k_LCK_SigFacHldTim_ActSta = Simulink.Parameter(1500, StorageClass="ExportedGlobal", DataType="single")
k_LCK_SigFacHldTim_DrvStim = Simulink.Parameter(4000, StorageClass="ExportedGlobal", DataType="single")
k_LCK_StepTimCon_FfwCmdRmpDwn = Simulink.Parameter(3, StorageClass="ExportedGlobal", DataType="single")
k_LCK_StepTimCon_FfwCmdRmpUp = Simulink.Parameter(4, StorageClass="ExportedGlobal", DataType="single")
k_LCK_StepTimCon_TorqCmdRmpDwn = Simulink.Parameter(5, StorageClass="ExportedGlobal", DataType="single")
k_LCK_StepTimCon_TorqCmdRmpUp = Simulink.Parameter(3, StorageClass="ExportedGlobal", DataType="single")
k_LCK_StrAngBks = Simulink.Parameter([0 3 6 10 15 30 45 70], StorageClass="ExportedGlobal", DataType="single")
k_LCK_StrSpdBks = Simulink.Parameter([0 4 8 12 16 20 24 28], StorageClass="ExportedGlobal", DataType="single")
k_LCK_TimBks_ActSta = Simulink.Parameter([0 1000 2000 3000 4000 5000 6000], StorageClass="ExportedGlobal", DataType="single")
k_LCK_TimBks_DrvStm = Simulink.Parameter([0 1000 2000 3000 4000 5000 6000], StorageClass="ExportedGlobal", DataType="single")
k_LCK_TimCon_A0Flt_Normal = Simulink.Parameter(20, StorageClass="ExportedGlobal", DataType="single")
k_LCK_TimCon_A0Flt_Strong = Simulink.Parameter(200, StorageClass="ExportedGlobal", DataType="single")
k_LCK_TimCon_A1Flt_Normal = Simulink.Parameter(20, StorageClass="ExportedGlobal", DataType="single")
k_LCK_TimCon_A1Flt_Strong = Simulink.Parameter(500, StorageClass="ExportedGlobal", DataType="single")
k_LCK_TimCon_A2Flt_Normal = Simulink.Parameter(20, StorageClass="ExportedGlobal", DataType="single")
k_LCK_TimCon_A2Flt_Strong = Simulink.Parameter(200, StorageClass="ExportedGlobal", DataType="single")
k_LCK_TimCon_A3Flt_Normal = Simulink.Parameter(0, StorageClass="ExportedGlobal", DataType="single")
k_LCK_TimCon_A3Flt_Strong = Simulink.Parameter(200, StorageClass="ExportedGlobal", DataType="single")
k_LCK_TimCon_RadFlt = Simulink.Parameter(20, StorageClass="ExportedGlobal", DataType="single")
k_LCK_TimCon_YawRtFlt = Simulink.Parameter(10, StorageClass="ExportedGlobal", DataType="single")
k_LCK_TorqCmdBks = Simulink.Parameter([0 0.1 0.2 0.3 0.4 0.5 0.6 0.7 0.8 0.9 1 1.2 1.4 1.6 1.8 2 2.2 2.4 2.6 3], StorageClass="ExportedGlobal", DataType="single")
k_LCK_TorqThr_DrvStim = Simulink.Parameter(0.8, StorageClass="ExportedGlobal", DataType="single")
k_LCK_TorqThrBig_DrvStim = Simulink.Parameter(2, StorageClass="ExportedGlobal", DataType="single")
k_LCK_VehInCurRadLowLmt = Simulink.Parameter(3800, StorageClass="ExportedGlobal", DataType="single")
k_LCK_VehInCurRadUpLmt = Simulink.Parameter(4000, StorageClass="ExportedGlobal", DataType="single")
k_LCK_VspdBks = Simulink.Parameter([0 3 10 20 30 40 50 60 70 80 90 100 110 120 130 140], StorageClass="ExportedGlobal", DataType="single")
k_LCK_YawRate_Offset_LftCurv = Simulink.Parameter([0.1 0.1 0.1 0.1 0.1 0.1 0.1 0.15 0.2 0.2 0.2 0.2 0.2 0], StorageClass="ExportedGlobal", DataType="single")
k_LCK_YawRate_Offset_RgtCurv = Simulink.Parameter([0.1 0.1 0.1 0.1 0.1 0.1 0.1 0.1 0.1 0.1 0.1 0.1 0.1 0], StorageClass="ExportedGlobal", DataType="single")
k_LCK_YawRate_OffsetFac_Vspd = Simulink.Parameter(repmat(1, 1, 16), StorageClass="ExportedGlobal", DataType="single")
k_LCK_YawRateSign = Simulink.Parameter(-1, StorageClass="ExportedGlobal", DataType="single")
k_LCK_YR_OffstFac_Dy_LftCurv = Simulink.Parameter([0.5 0.5 0.5 0.5 0.5 0.5 0.5 0.5 0.5 0.5 1 1 1 1 1 1 1 1 1], StorageClass="ExportedGlobal", DataType="single")
k_LCK_YR_OffstFac_Dy_RgtCurv = Simulink.Parameter(repmat(1, 1, 19), StorageClass="ExportedGlobal", DataType="single")
k_LCK_PFac_Vspd = Simulink.Parameter([0 0 1 1 1 1 1 1 1 1.05 1.1 1.15 1.2 1.2 1.2 1.2], StorageClass="ExportedGlobal", DataType="single")
k_LCK_LatCtrl_Kp = Simulink.Parameter(3.1, StorageClass="ExportedGlobal", DataType="single")
k_LCK_LatCtrl_Kd = Simulink.Parameter(2.9, StorageClass="ExportedGlobal", DataType="single")
k_LCK_Lat_Ctrl_Kp_NearGain = Simulink.Parameter(0.7, StorageClass="ExportedGlobal", DataType="single")
k_LCK_DFac_HaCurCen = Simulink.Parameter([1 0.85 0.8 0.75 0.7 0.65 0.6 0.55 0.5 0.45], StorageClass="ExportedGlobal", DataType="single")
k_LCK_DFac_HaCurSid = Simulink.Parameter([1 0.9 0.8 0.7 0.65 0.63 0.55 0.5 0.45 0.3], StorageClass="ExportedGlobal", DataType="single")
k_LCK_DFac_HadCurCen = Simulink.Parameter([1 0.85 0.75 0.7 0.65 0.6 0.55 0.55 0.5 0.5], StorageClass="ExportedGlobal", DataType="single")
k_LCK_DFac_HadCurSid = Simulink.Parameter([1 0.9 0.8 0.7 0.65 0.6 0.5 0.5 0.45 0.4], StorageClass="ExportedGlobal", DataType="single")
k_LCK_DFac_HadStrCen = Simulink.Parameter([1 0.85 0.7 0.6 0.55 0.5 0.45 0.35 0.3 0.25], StorageClass="ExportedGlobal", DataType="single")
k_LCK_DFac_HadStrSid = Simulink.Parameter([1 1 0.8 0.55 0.45 0.4 0.35 0.35 0.25 0.15], StorageClass="ExportedGlobal", DataType="single")
k_LCK_DFac_HaStrCen = Simulink.Parameter([1 0.9 0.8 0.7 0.65 0.6 0.6 0.55 0.4 0.3], StorageClass="ExportedGlobal", DataType="single")
k_LCK_DFac_HaStrSid = Simulink.Parameter([1 1 0.9 0.78 0.73 0.7 0.65 0.6 0.5 0.35], StorageClass="ExportedGlobal", DataType="single")
k_LCK_PFac_HaCurCen = Simulink.Parameter([1 0.9 0.85 0.8 0.75 0.7 0.65 0.6 0.55 0.5], StorageClass="ExportedGlobal", DataType="single")
k_LCK_PFac_HaCurSid = Simulink.Parameter([1 0.9 0.8 0.7 0.68 0.65 0.6 0.55 0.5 0.35], StorageClass="ExportedGlobal", DataType="single")
k_LCK_PFac_HadCurCen = Simulink.Parameter([1 0.9 0.85 0.7 0.65 0.6 0.55 0.5 0.5 0.5], StorageClass="ExportedGlobal", DataType="single")
k_LCK_PFac_HadCurSid = Simulink.Parameter([1 0.9 0.8 0.7 0.65 0.6 0.5 0.45 0.4 0.4], StorageClass="ExportedGlobal", DataType="single")
k_LCK_PFac_HadStrCen = Simulink.Parameter([1 0.9 0.7 0.65 0.6 0.5 0.45 0.35 0.3 0.3], StorageClass="ExportedGlobal", DataType="single")
k_LCK_PFac_HadStrSid = Simulink.Parameter([1 0.9 0.8 0.7 0.58 0.45 0.4 0.35 0.25 0.2], StorageClass="ExportedGlobal", DataType="single")
k_LCK_PFac_HaStrCen = Simulink.Parameter([1 1 0.9 0.75 0.67 0.65 0.65 0.6 0.45 0.4], StorageClass="ExportedGlobal", DataType="single")
k_LCK_PFac_HaStrSid = Simulink.Parameter([1 1 0.9 0.83 0.8 0.75 0.7 0.68 0.55 0.35], StorageClass="ExportedGlobal", DataType="single")
k_LCK_FfwTorq_Cvat = Simulink.Parameter([0 0.06 0.15 0.25 0.4 0.54 0.7 0.85 1.02 1.12 1.25 1.4 1.55 1.7 1.8 2], StorageClass="ExportedGlobal", DataType="single")