% Simulink data dictionary LCK_LogicPara.sldd

c_BIT0 = Simulink.Parameter(1, StorageClass="ExportedGlobal", DataType="uint16")
c_BIT1 = Simulink.Parameter(2, StorageClass="ExportedGlobal", DataType="uint16")
c_BIT2 = Simulink.Parameter(4, StorageClass="ExportedGlobal", DataType="uint16")
c_BIT3 = Simulink.Parameter(8, StorageClass="ExportedGlobal", DataType="uint16")
c_BIT4 = Simulink.Parameter(16, StorageClass="ExportedGlobal", DataType="uint16")
c_BIT5 = Simulink.Parameter(32, StorageClass="ExportedGlobal", DataType="uint16")
c_BIT6 = Simulink.Parameter(64, StorageClass="ExportedGlobal", DataType="uint16")
c_BIT7 = Simulink.Parameter(128, StorageClass="ExportedGlobal", DataType="uint16")
c_BIT8 = Simulink.Parameter(256, StorageClass="ExportedGlobal", DataType="uint16")
c_BIT9 = Simulink.Parameter(512, StorageClass="ExportedGlobal", DataType="uint16")
c_BIT10 = Simulink.Parameter(1024, StorageClass="ExportedGlobal", DataType="uint16")
c_BIT11 = Simulink.Parameter(2048, StorageClass="ExportedGlobal", DataType="uint16")
c_BIT12 = Simulink.Parameter(4096, StorageClass="ExportedGlobal", DataType="uint16")
c_BIT13 = Simulink.Parameter(8192, StorageClass="ExportedGlobal", DataType="uint16")
c_BIT14 = Simulink.Parameter(16384, StorageClass="ExportedGlobal", DataType="uint16")
c_BIT15 = Simulink.Parameter(32768, StorageClass="ExportedGlobal", DataType="uint16")
k_accel_pedal_pos_per_speed_x = Simulink.Parameter([60 70 80 90 100 110 120 130 140 150 160 170 180], StorageClass="ExportedGlobal", DataType="single")
k_accel_pedal_pos_per_speed_z = Simulink.Parameter([16 18 20 25 33 38 44 47 53 56 60 65 70], StorageClass="ExportedGlobal", DataType="single")
k_brake_ped_pos_threshold = Simulink.Parameter(10, StorageClass="ExportedGlobal", DataType="single")
k_brake_pedal_hold_msec = Simulink.Parameter(80, StorageClass="ExportedGlobal", DataType="single")
k_brake_pedal_pos_filter_tau = Simulink.Parameter(20, StorageClass="ExportedGlobal", DataType="single")
k_driver_appl_torque_filt = Simulink.Parameter(50, StorageClass="ExportedGlobal", DataType="single")
k_driver_suppression_hold_time = Simulink.Parameter(3000, StorageClass="ExportedGlobal", DataType="single")
k_hands_on_wheel_hold_msec = Simulink.Parameter(500, StorageClass="ExportedGlobal", DataType="single")
k_hands_on_wheel_torque_hi = Simulink.Parameter(0.2, StorageClass="ExportedGlobal", DataType="single")
k_hands_on_wheel_torque_lo = Simulink.Parameter(0.15, StorageClass="ExportedGlobal", DataType="single")
k_handsoff_delay_cycles = Simulink.Parameter(50, StorageClass="ExportedGlobal", DataType="single")
k_handsoff_torq_Lo_CR = Simulink.Parameter(0.3, StorageClass="ExportedGlobal", DataType="single")
k_handson_delay_cycles = Simulink.Parameter(5, StorageClass="ExportedGlobal", DataType="single")
k_HighAccel_suppress_hold = Simulink.Parameter(3000, StorageClass="ExportedGlobal", DataType="single")
k_HLR_suprress_hold = Simulink.Parameter(3000, StorageClass="ExportedGlobal", DataType="single")
k_hs_brake_ped_pos_threshold = Simulink.Parameter(12, StorageClass="ExportedGlobal", DataType="single")
k_hs_StrAng_CR_threshold_z = Simulink.Parameter([65 65 65 62 58 53 45], StorageClass="ExportedGlobal", DataType="single")
k_LCK_A0_Rdy2Act_UseConst = Simulink.Parameter(0, StorageClass="ExportedGlobal", DataType="single")
k_LCK_Active2Ready_Mask = Simulink.Parameter(255, StorageClass="ExportedGlobal", DataType="single")
k_LCK_Enable_POOnly = Simulink.Parameter(1, StorageClass="ExportedGlobal", DataType="single")
k_LCK_Entry_DistBuffer = Simulink.Parameter(0.1, StorageClass="ExportedGlobal", DataType="single")
k_LCK_HaloTime_Switch = Simulink.Parameter(0, StorageClass="ExportedGlobal", DataType="single")
k_LCK_HndsOnWhel_DlyTm_Idl2Rdy = Simulink.Parameter(0, StorageClass="ExportedGlobal", DataType="single")
k_LCK_host_veh_width = Simulink.Parameter(1.86, StorageClass="ExportedGlobal", DataType="single")
k_LCK_Idle2Ready_Mask = Simulink.Parameter(239, StorageClass="ExportedGlobal", DataType="single")
k_LCK_Junc_SusTime = Simulink.Parameter(1, StorageClass="ExportedGlobal", DataType="single")
k_LCK_LM_ROC_DlyTm_Idl2Rdy = Simulink.Parameter(1.5, StorageClass="ExportedGlobal", DataType="single")
k_LCK_LM_ROC_DlyTm_Rdy2Idl = Simulink.Parameter(2, StorageClass="ExportedGlobal", DataType="single")
k_LCK_LnCetr_DlyTm_Rdy2Act = Simulink.Parameter(0.5, StorageClass="ExportedGlobal", DataType="single")
k_LCK_LnWidth_DlyTm_Idl2Rdy = Simulink.Parameter(1, StorageClass="ExportedGlobal", DataType="single")
k_LCK_LnWidth_DlyTm_Rdy2Idl = Simulink.Parameter(1, StorageClass="ExportedGlobal", DataType="single")
k_LCK_LnWidth_LowLmt_Idl2Rdy = Simulink.Parameter(2.6, StorageClass="ExportedGlobal", DataType="single")
k_LCK_LnWidth_LowLmt_Rdy2Idl = Simulink.Parameter(2.6, StorageClass="ExportedGlobal", DataType="single")
k_LCK_LnWidth_UpLmt_Idl2Rdy = Simulink.Parameter(5.2, StorageClass="ExportedGlobal", DataType="single")
k_LCK_LnWidth_UpLmt_Rdy2Idl = Simulink.Parameter(5.2, StorageClass="ExportedGlobal", DataType="single")
k_LCK_LowRng_Spd_Thr = Simulink.Parameter(20, StorageClass="ExportedGlobal", DataType="single")
k_LCK_MinJunction_Range = Simulink.Parameter(0, StorageClass="ExportedGlobal", DataType="single")
k_LCK_Ovrd_DlyTm_Rdy2Idl = Simulink.Parameter(0.1, StorageClass="ExportedGlobal", DataType="single")
k_LCK_Ovrd_Torq_Hys = Simulink.Parameter(0, StorageClass="ExportedGlobal", DataType="single")
k_LCK_ovrd_torq_thold_per_spd_x = Simulink.Parameter([10 30 50 80 120 180], StorageClass="ExportedGlobal", DataType="single")
k_LCK_ovrd_torq_thold_per_spd_z = Simulink.Parameter([1.5 1.56 1.66 1.72 1.76 1.8], StorageClass="ExportedGlobal", DataType="single")
k_LCK_Range_Drop_MinDur = Simulink.Parameter(0.2, StorageClass="ExportedGlobal", DataType="single")
k_LCK_Ready2Active_Mask = Simulink.Parameter(255, StorageClass="ExportedGlobal", DataType="single")
k_LCK_Ready2Idle_Mask = Simulink.Parameter(503, StorageClass="ExportedGlobal", DataType="single")
k_LCK_Rng2VehSpd_Ratio_DlyTime = Simulink.Parameter(0.1, StorageClass="ExportedGlobal", DataType="single")
k_LCK_Rng2VehSpd_Ratio_Thr = Simulink.Parameter(0.23, StorageClass="ExportedGlobal", DataType="single")
k_LCK_ROC_filt_tau = Simulink.Parameter(75, StorageClass="ExportedGlobal", DataType="single")
k_LCK_SP_A0_Rdy2Act = Simulink.Parameter(1, StorageClass="ExportedGlobal", DataType="single")
k_LCK_SP_A0_Rdy2Act_Max = Simulink.Parameter(1.5, StorageClass="ExportedGlobal", DataType="single")
k_LCK_SP_A0_Rdy2Act_Min = Simulink.Parameter(0.6, StorageClass="ExportedGlobal", DataType="single")
k_LCK_SP_A1_Rdy2Act = Simulink.Parameter(0.03, StorageClass="ExportedGlobal", DataType="single")
k_LCK_SP_Conf_Low_JuncTm = Simulink.Parameter(0.05, StorageClass="ExportedGlobal", DataType="single")
k_LCK_SP_Conf_Med_JuncTm = Simulink.Parameter(0.2, StorageClass="ExportedGlobal", DataType="single")
k_LCK_SPconfInvld_DlyTm_Rdy2Idl = Simulink.Parameter(0.1, StorageClass="ExportedGlobal", DataType="single")
k_LCK_SPconfLow_DlyTm_Rdy2Idl = Simulink.Parameter(0.8, StorageClass="ExportedGlobal", DataType="single")
k_LCK_SPconfLow_DlyTm_Rdy2Idl_x = Simulink.Parameter([0 10 20 30 40 50 60 70 80 90 100 110 120 130 140 150], StorageClass="ExportedGlobal", DataType="single")
k_LCK_SPconfLow_DlyTm_Rdy2Idl_z = Simulink.Parameter(repmat(3, 1, 16), StorageClass="ExportedGlobal", DataType="single")
k_LCK_SPconfMed_DlyTm_Rdy2Idl = Simulink.Parameter(10, StorageClass="ExportedGlobal", DataType="single")
k_LCK_SPconfMed_DlyTm_Rdy2Idl_x = Simulink.Parameter([0 10 20 30 40 50 60 70 80 90 100 110 120 130 140 150], StorageClass="ExportedGlobal", DataType="single")
k_LCK_SPconfMed_DlyTm_Rdy2Idl_z = Simulink.Parameter(repmat(10, 1, 16), StorageClass="ExportedGlobal", DataType="single")
k_LCK_SPHighSpd_DlyTm_Idl2Rdy = Simulink.Parameter(0.5, StorageClass="ExportedGlobal", DataType="single")
k_LCK_SPLowSpd_DlyTm_Idl2Rdy = Simulink.Parameter(0.5, StorageClass="ExportedGlobal", DataType="single")
k_LCK_SPPConf_DlyTm = Simulink.Parameter(0.1, StorageClass="ExportedGlobal", DataType="single")
k_LCK_SPPConfHigh_ProbThre = Simulink.Parameter(0.8, StorageClass="ExportedGlobal", DataType="single")
k_LCK_SPPConfMed_ProbThre = Simulink.Parameter(0.3, StorageClass="ExportedGlobal", DataType="single")
k_LCK_SPPConfMedHigh_ProbThre = Simulink.Parameter(0.5, StorageClass="ExportedGlobal", DataType="single")
k_LCK_SPPType_DlyTm = Simulink.Parameter(0.1, StorageClass="ExportedGlobal", DataType="single")
k_LCK_SPTyp_LowLmt_Idl2Rdy = Simulink.Parameter(3, StorageClass="ExportedGlobal", DataType="single")
k_LCK_SPTyp_UpLmt_Idl2Rdy = Simulink.Parameter(7, StorageClass="ExportedGlobal", DataType="single")
k_LCK_StrAng_CR_threshold_z = Simulink.Parameter([60 60 60 57 53 48 40], StorageClass="ExportedGlobal", DataType="single")
k_LCK_TinCon_LaneProbFlt = Simulink.Parameter(40, StorageClass="ExportedGlobal", DataType="single")
k_LCK_UseSP_MaxRange = Simulink.Parameter(0, StorageClass="ExportedGlobal", DataType="single")
k_LCK_VehSpd_LowLmtFus_Idl2Rdy = Simulink.Parameter(0, StorageClass="ExportedGlobal", DataType="single")
k_LCK_VehSpd_LowlmtVis_Idl2Rdy = Simulink.Parameter(0, StorageClass="ExportedGlobal", DataType="single")
k_LCK_VehSpd_LowlmtVis_Rdy2Idl = Simulink.Parameter(0, StorageClass="ExportedGlobal", DataType="single")
k_LCK_VehSpd_TJA_ICA_Bound = Simulink.Parameter(60, StorageClass="ExportedGlobal", DataType="single")
k_LCK_VehSpd_Uplmt_Idl2Rdy = Simulink.Parameter(140, StorageClass="ExportedGlobal", DataType="single")
k_LCK_VehSpd_Uplmt_Rdy2Idl = Simulink.Parameter(145, StorageClass="ExportedGlobal", DataType="single")
k_LCK_VisionOnly = Simulink.Parameter(0, StorageClass="ExportedGlobal", DataType="single")
k_LCK_YawRate_DlyTm_Idl2Rdy = Simulink.Parameter(1, StorageClass="ExportedGlobal", DataType="single")
k_LCK_YawRateThr_Act2Rdy_ROC_x = Simulink.Parameter([300 400 500 600 800 1000], StorageClass="ExportedGlobal", DataType="single")
k_LCK_YawRateThr_Act2Rdy_z = Simulink.Parameter(repmat(12, 1, 6), StorageClass="ExportedGlobal", DataType="single")
k_LCK_YawRateThr_DlyTm_Act2Rdy = Simulink.Parameter(0.1, StorageClass="ExportedGlobal", DataType="single")
k_LCK_YawRateThr_Idl2Rdy = Simulink.Parameter(11.4, StorageClass="ExportedGlobal", DataType="single")
k_ls_brake_ped_pos_threshold = Simulink.Parameter(8, StorageClass="ExportedGlobal", DataType="single")
k_ls_StrAng_CR_threshold_z = Simulink.Parameter([55 55 55 52 48 43 35], StorageClass="ExportedGlobal", DataType="single")
k_override_left_torq_thold = Simulink.Parameter(3, StorageClass="ExportedGlobal", DataType="single")
k_override_right_torq_thold = Simulink.Parameter(-3, StorageClass="ExportedGlobal", DataType="single")
k_override_torq_sustain_period = Simulink.Parameter(500, StorageClass="ExportedGlobal", DataType="single")
k_Ovrd_torq_thold_per_spd_sw = Simulink.Parameter(1, StorageClass="ExportedGlobal", DataType="single")
k_StrAng_CR_hold_msec = Simulink.Parameter(80, StorageClass="ExportedGlobal", DataType="single")
k_StrAng_CR_suppress_hold = Simulink.Parameter(3000, StorageClass="ExportedGlobal", DataType="single")
k_StrAng_CR_threshold_x = Simulink.Parameter([20 40 60 80 120 150 180], StorageClass="ExportedGlobal", DataType="single")
k_StrAng_CR_threshold_z = Simulink.Parameter([60 60 60 57 53 48 40], StorageClass="ExportedGlobal", DataType="single")
k_StrAng_filter_tau = Simulink.Parameter(0, StorageClass="ExportedGlobal", DataType="single")
k_turn_suprress_hold = Simulink.Parameter(3000, StorageClass="ExportedGlobal", DataType="single")
k_Use_Constant_SPP_Timer = Simulink.Parameter(0, StorageClass="ExportedGlobal", DataType="single")
k_LCK_HaloTime = Simulink.Parameter(2000, StorageClass="ExportedGlobal", DataType="single")
k_LCK_accel_inhibit_thold = Simulink.Parameter(35, StorageClass="ExportedGlobal", DataType="single")
k_LCG_Configured = Simulink.Parameter(1, StorageClass="ExportedGlobal", DataType="single")
k_LC_Exit_Switch = Simulink.Parameter(0, StorageClass="ExportedGlobal", DataType="single")
k_brake_suprress_hold = Simulink.Parameter(1000, StorageClass="ExportedGlobal", DataType="single")
k_LCK_TJALCK_SWSpeed = Simulink.Parameter(600, StorageClass="ExportedGlobal", DataType="single")
k_LCK_LM_ROC_Idl2Rdy = Simulink.Parameter(100, StorageClass="ExportedGlobal", DataType="single")
k_LCK_LM_ROC_Rdy2Idl = Simulink.Parameter(50, StorageClass="ExportedGlobal", DataType="single")