% Simulink data dictionary LCK_Macro.sldd

C_KPH2MPS = Simulink.Parameter(0.2778, StorageClass="ExportedGlobal", DataType="single")
C_DEG2RAD = Simulink.Parameter(0.0175, StorageClass="ExportedGlobal", DataType="single")
C_RAD2DEG = Simulink.Parameter(57.2958, StorageClass="ExportedGlobal", DataType="single")
LCK_MODE_ACTIVE = Simulink.Parameter(4, StorageClass="ExportedGlobal", DataType="single")
C_NEARZERO = Simulink.Parameter(0.0001, StorageClass="ExportedGlobal", DataType="single")
LCK_BOOLEAN_TURE = Simulink.Parameter(1, StorageClass="ExportedGlobal", DataType="boolean")
LCK_BOOLEAN_FALSE = Simulink.Parameter(0, StorageClass="ExportedGlobal", DataType="boolean")
LCK_MODE_ERROR = Simulink.Parameter(0, StorageClass="ExportedGlobal", DataType="single")
LCK_MODE_OFF = Simulink.Parameter(1, StorageClass="ExportedGlobal", DataType="single")
LCK_MODE_IDLE = Simulink.Parameter(2, StorageClass="ExportedGlobal", DataType="single")
LCK_MODE_READY = Simulink.Parameter(3, StorageClass="ExportedGlobal", DataType="single")
C_ZERO = Simulink.Parameter(0, StorageClass="ExportedGlobal", DataType="single")
LEFT_TURN_SIGNAL = Simulink.Parameter(1, StorageClass="ExportedGlobal", DataType="single")
C_MPS2KPH = Simulink.Parameter(3.6, StorageClass="ExportedGlobal", DataType="single")
TJA_SP_TYPE_POONLY = Simulink.Parameter(4, StorageClass="ExportedGlobal", DataType="single")
TJA_SP_CONF_MEDIUM = Simulink.Parameter(2, StorageClass="ExportedGlobal", DataType="single")
TJA_SP_TYPE_BLMONLY = Simulink.Parameter(3, StorageClass="ExportedGlobal", DataType="single")
TJA_SP_TYPE_POBLM = Simulink.Parameter(7, StorageClass="ExportedGlobal", DataType="single")
C_ONE = Simulink.Parameter(1, StorageClass="ExportedGlobal", DataType="single")
ML_TIME_MSEC = Simulink.Parameter(20, StorageClass="ExportedGlobal", DataType="single")
ML_TIME_SEC = Simulink.Parameter(0.02, StorageClass="ExportedGlobal", DataType="single")
LCK_MODE_LEFT_LANE_CHANGE = Simulink.Parameter(5, StorageClass="ExportedGlobal", DataType="single")
LCK_MODE_RIGHT_LANE_CHANGE = Simulink.Parameter(6, StorageClass="ExportedGlobal", DataType="single")
RIGHT_TURN_SIGNAL = Simulink.Parameter(2, StorageClass="ExportedGlobal", DataType="single")