% Simulink data dictionary LCK_Signal.sldd

SPP_A0 = Simulink.Signal(StorageClass="ExportedGlobal", DataType="single")
SPP_A1 = Simulink.Signal(StorageClass="ExportedGlobal", DataType="single")
SPP_A2 = Simulink.Signal(StorageClass="ExportedGlobal", DataType="single")
SPP_A3 = Simulink.Signal(StorageClass="ExportedGlobal", DataType="single")
Previewed_Dy = Simulink.Signal(StorageClass="ExportedGlobal", DataType="single")
Current_Dy = Simulink.Signal(StorageClass="ExportedGlobal", DataType="single")
Lat_Rate = Simulink.Signal(StorageClass="ExportedGlobal", DataType="single")
Hed_Ang = Simulink.Signal(StorageClass="ExportedGlobal", DataType="single")
Hed_Ang_Rate = Simulink.Signal(StorageClass="ExportedGlobal", DataType="single")
Road_Radius = Simulink.Signal(StorageClass="ExportedGlobal", DataType="single")
Current_Curvature = Simulink.Signal(StorageClass="ExportedGlobal", DataType="single")
Future_Curvature = Simulink.Signal(StorageClass="ExportedGlobal", DataType="single")
Curvature_Rate = Simulink.Signal(StorageClass="ExportedGlobal", DataType="single")
FfwFac_CvatRate = Simulink.Signal(StorageClass="ExportedGlobal", DataType="single")
FfwFac_Dy = Simulink.Signal(StorageClass="ExportedGlobal", DataType="single")
FfwTorq_Basic = Simulink.Signal(StorageClass="ExportedGlobal", DataType="single")
FfwTorq_Delta = Simulink.Signal(StorageClass="ExportedGlobal", DataType="single")
Ffw_Ctrl_Cmd = Simulink.Signal(StorageClass="ExportedGlobal", DataType="single")
LCK_PID_TorqCmd = Simulink.Signal(StorageClass="ExportedGlobal", DataType="single")
LCK_PIDPlusFfw_TorqCmd = Simulink.Signal(StorageClass="ExportedGlobal", DataType="single")
LCK_PIDTorqCmd_Percent = Simulink.Signal(StorageClass="ExportedGlobal", DataType="single")
LCK_FinalTorqCmd = Simulink.Signal(StorageClass="ExportedGlobal", DataType="single")
SPP_Flase_Recognition_Type = Simulink.Signal(StorageClass="ExportedGlobal", DataType="uint8")
I_Term_Reset_Flag = Simulink.Signal(StorageClass="ExportedGlobal", DataType="boolean")
LatCtrl_P1Gain = Simulink.Signal(StorageClass="ExportedGlobal", DataType="single")
LatCtrl_D1Gain = Simulink.Signal(StorageClass="ExportedGlobal", DataType="single")
LatCtrl_P0Gain = Simulink.Signal(StorageClass="ExportedGlobal", DataType="single")
LatCtrl_D0Gain = Simulink.Signal(StorageClass="ExportedGlobal", DataType="single")
LatCtrl_P0_Gain = Simulink.Signal(StorageClass="ExportedGlobal", DataType="single")
LatCtrl_LCK_TorqCmd = Simulink.Signal(StorageClass="ExportedGlobal", DataType="single")
LatCtrl_Cmd = Simulink.Signal(StorageClass="ExportedGlobal", DataType="single")
Lat_Ctrl_Cmd = Simulink.Signal(StorageClass="ExportedGlobal", DataType="single")
LatCtrl_D_Term = Simulink.Signal(StorageClass="ExportedGlobal", DataType="single")
Lat_Ctrl_D_Term = Simulink.Signal(StorageClass="ExportedGlobal", DataType="single")
LatCtrl_P_Term = Simulink.Signal(StorageClass="ExportedGlobal", DataType="single")
Lat_Ctrl_P_Term = Simulink.Signal(StorageClass="ExportedGlobal", DataType="single")
LCK_Dy = Simulink.Signal(StorageClass="ExportedGlobal", DataType="single")
Lat_Ctrl_I_Term = Simulink.Signal(StorageClass="ExportedGlobal", DataType="single")
LatCtrl_LCK_LanSigInputs = Simulink.Signal(StorageClass="ExportedGlobal", DataType="Bus: LatCtrl_LCK_LanSigInputs_t")
LatCtrl_LCK_LogicSigInputs = Simulink.Signal(StorageClass="ExportedGlobal", DataType="Bus: LatCtrl_LCK_LogicSigInputs_t")

LatCtrl_LCK_LogicSigInputs_t = Simulink.Bus(DataScope="Exported")
  LCK_Mode: uint8

LatCtrl_LCK_TrackSigInputs = Simulink.Signal(StorageClass="ExportedGlobal", DataType="Bus: LatCtrl_LCK_TrackSigInputs_t")

LatCtrl_LCK_TrackSigInputs_t = Simulink.Bus(DataScope="Exported")
  CIPV1ObjTrackID: uint8
  CIPV1ObjRange: single

LatCtrl_LCK_VehSigInputs = Simulink.Signal(StorageClass="ExportedGlobal", DataType="Bus: LatCtrl_LCK_VehSigInputs_t")

LatCtrl_LCK_VehSigInputs_t = Simulink.Bus(DataScope="Exported")
  Vehicle_Speed: single
  Steer_Ang: single
  Steer_Spd: single
  Steer_Torq: single
  Veh_Yaw_Rate: single
  LDWLKASwReq: single
  LKATrqOvrlTrqDStat: single
  DirectionIndSwitchPos: single
  BrkPedalApplied: boolean
  AccPedalPosition: single
  Gear_Pos: single

LatCtrl_LCK_LanSigInputs_t = Simulink.Bus(DataScope="Exported")
  VID_Lin_01_ProbExists: single
  VID_Lin_01_Type: single
  VID_Lin_01_A0: single
  VID_Lin_01_A1: single
  VID_Lin_01_A2: single
  VID_Lin_01_A3: single
  VID_Lin_01_Range: single
  VID_Lin_02_ProbExists: single
  VID_Lin_02_Type: single
  VID_Lin_02_A0: single
  VID_Lin_02_A1: single
  VID_Lin_02_A2: single
  VID_Lin_02_A3: single
  VID_Lin_02_Range: single
  VID_Lane_Width: single

LatCtrl_LCK_SPPInfo_t = Simulink.Bus(DataScope="Exported")
  SPP_Conf: single
  SPP_Type: single
  SPP_A0: single
  SPP_A1: single
  SPP_A2: single
  SPP_A3: single

LatCtrl_LCK_SPPInfo = Simulink.Signal(StorageClass="ExportedGlobal", DataType="Bus: LatCtrl_LCK_SPPInfo_t")

HMI_Lateral_t = Simulink.Bus()
  LKS_Error: single
  LKS_Passive_Rea: single
  LKS_Status: single
  LC_pro_reason: single
  LC_Proposal: single
  LC_Reason: single
  LC_Request: single
  LC_Tip: single
  LC_Fail_Tip: single
  LC_Dis_dy: single
  LC_Dis_dx: single
  LC_Direction: single
  Handsoff_Warning: single