% Simulink data dictionary LM_TOS.sldd
% references Func_Global.sldd

HWA_TARGETOBJECT_OUTPUT_ST = Simulink.Bus()
  L_NEIGHBORLANE_TAROBJ_0_ST: Bus: TARGETOBJECT
  L_NEIGHBORLANE_TAROBJ_1_ST: Bus: TARGETOBJECT
  L_NEIGHBORLANE_TAROBJ_2_ST: Bus: TARGETOBJECT
  L_NEIGHBORLANE_TAROBJ_3_ST: Bus: TARGETOBJECT
  EGOLANE_TAROBJ_0_ST: Bus: TARGETOBJECT
  EGOLANE_TAROBJ_1_ST: Bus: TARGETOBJECT
  EGOLANE_TAROBJ_2_ST: Bus: TARGETOBJECT
  EGOLANE_TAROBJ_3_ST: Bus: TARGETOBJECT
  R_NEIGHBORLANE_TAROBJ_0_ST: Bus: TARGETOBJECT
  R_NEIGHBORLANE_TAROBJ_1_ST: Bus: TARGETOBJECT
  R_NEIGHBORLANE_TAROBJ_2_ST: Bus: TARGETOBJECT
  R_NEIGHBORLANE_TAROBJ_3_ST: Bus: TARGETOBJECT

TARGETOBJECT = Simulink.Bus()
  dis2EgoLaneCenter: single
  TTC_f: single
  ID_un8: uint8
  Index_un8: uint8
  probWithinLane_arr_f: single[5]
  probCutIn_f: single
  probCutOut_f: single
  overlap_f: single
  trackingTimeWithinLane_f: single

FUS_OUTOBJ_LIST_ST = Simulink.Bus()
  fus_output_01_obj: Bus: FUS_OBJ_DATA_ST
  fus_output_02_obj: Bus: FUS_OBJ_DATA_ST
  fus_output_03_obj: Bus: FUS_OBJ_DATA_ST
  fus_output_04_obj: Bus: FUS_OBJ_DATA_ST
  fus_output_05_obj: Bus: FUS_OBJ_DATA_ST
  fus_output_06_obj: Bus: FUS_OBJ_DATA_ST
  fus_output_07_obj: Bus: FUS_OBJ_DATA_ST
  fus_output_08_obj: Bus: FUS_OBJ_DATA_ST
  fus_output_09_obj: Bus: FUS_OBJ_DATA_ST
  fus_output_10_obj: Bus: FUS_OBJ_DATA_ST
  fus_output_11_obj: Bus: FUS_OBJ_DATA_ST
  fus_output_12_obj: Bus: FUS_OBJ_DATA_ST
  fus_output_13_obj: Bus: FUS_OBJ_DATA_ST
  fus_output_14_obj: Bus: FUS_OBJ_DATA_ST
  fus_output_15_obj: Bus: FUS_OBJ_DATA_ST
  fus_output_16_obj: Bus: FUS_OBJ_DATA_ST
  fus_output_17_obj: Bus: FUS_OBJ_DATA_ST
  fus_output_18_obj: Bus: FUS_OBJ_DATA_ST
  fus_output_19_obj: Bus: FUS_OBJ_DATA_ST
  fus_output_20_obj: Bus: FUS_OBJ_DATA_ST
  fus_output_21_obj: Bus: FUS_OBJ_DATA_ST
  fus_output_22_obj: Bus: FUS_OBJ_DATA_ST
  fus_output_23_obj: Bus: FUS_OBJ_DATA_ST
  fus_output_24_obj: Bus: FUS_OBJ_DATA_ST
  fus_output_25_obj: Bus: FUS_OBJ_DATA_ST
  fus_output_26_obj: Bus: FUS_OBJ_DATA_ST
  fus_output_27_obj: Bus: FUS_OBJ_DATA_ST
  fus_output_28_obj: Bus: FUS_OBJ_DATA_ST
  fus_output_29_obj: Bus: FUS_OBJ_DATA_ST
  fus_output_30_obj: Bus: FUS_OBJ_DATA_ST
  fus_output_31_obj: Bus: FUS_OBJ_DATA_ST
  fus_output_32_obj: Bus: FUS_OBJ_DATA_ST
  fus_output_33_obj: Bus: FUS_OBJ_DATA_ST
  fus_output_34_obj: Bus: FUS_OBJ_DATA_ST
  fus_output_35_obj: Bus: FUS_OBJ_DATA_ST
  fus_output_36_obj: Bus: FUS_OBJ_DATA_ST
  fus_output_37_obj: Bus: FUS_OBJ_DATA_ST
  fus_output_38_obj: Bus: FUS_OBJ_DATA_ST
  fus_output_39_obj: Bus: FUS_OBJ_DATA_ST
  fus_output_40_obj: Bus: FUS_OBJ_DATA_ST

TARGETOBJECT_adp = Simulink.Bus()
  dis2EgoLaneCenter: single
  TTC_f: single
  ID_un8: uint8
  Index_un8: uint8
  probWithinLane_arr_f_0: single
  probWithinLane_arr_f_1: single
  probWithinLane_arr_f_2: single
  probWithinLane_arr_f_3: single
  probWithinLane_arr_f_4: single
  probCutIn_f: single
  probCutOut_f: single
  overlap_f: single
  trackingTimeWithinLane_f: single

LANEMODEL_OUTPUT_ST_adp = Simulink.Bus()
  egoLaneID_un8: uint8  % ego vehicle lane:
    % from left to right, the num of lane is 0, 1, 2,,3,4;
    % 0:Lane_0
    % 1:Lane_1
    % 2:Lane_2
    % 3:Lane_3
    % 4:Lane_4
    % 255:unknow
  LANES_ST_0: Bus: LANE_ST_adp  % there are 5 lanes in the  road at most
  LANES_ST_1: Bus: LANE_ST_adp
  LANES_ST_2: Bus: LANE_ST_adp
  LANES_ST_3: Bus: LANE_ST_adp
  LANES_ST_4: Bus: LANE_ST_adp

SEGMENT_adp = Simulink.Bus()
  coef_arr_f_0: single
  coef_arr_f_1: single
  coef_arr_f_2: single
  coef_arr_f_3: single
  dlowerLimit_f: single
  dupperLimit_f: single
  numOfSegment_un8: uint8
  available_b: boolean
  detectedByVideo_b: boolean
  quality_f: single

SEGMENTS_ST_adp = Simulink.Bus()
  LANE_0_SEGMENT_0_ST_adp: Bus: SEGMENT_adp
  LANE_0_SEGMENT_1_ST_adp: Bus: SEGMENT_adp
  LANE_0_SEGMENT_2_ST_adp: Bus: SEGMENT_adp
  LANE_0_SEGMENT_3_ST_adp: Bus: SEGMENT_adp
  LANE_0_SEGMENT_4_ST_adp: Bus: SEGMENT_adp
  LANE_0_SEGMENT_5_ST_adp: Bus: SEGMENT_adp
  LANE_1_SEGMENT_0_ST_adp: Bus: SEGMENT_adp
  LANE_1_SEGMENT_1_ST_adp: Bus: SEGMENT_adp
  LANE_1_SEGMENT_2_ST_adp: Bus: SEGMENT_adp
  LANE_1_SEGMENT_3_ST_adp: Bus: SEGMENT_adp
  LANE_1_SEGMENT_4_ST_adp: Bus: SEGMENT_adp
  LANE_1_SEGMENT_5_ST_adp: Bus: SEGMENT_adp
  LANE_2_SEGMENT_0_ST_adp: Bus: SEGMENT_adp
  LANE_2_SEGMENT_1_ST_adp: Bus: SEGMENT_adp
  LANE_2_SEGMENT_2_ST_adp: Bus: SEGMENT_adp
  LANE_2_SEGMENT_3_ST_adp: Bus: SEGMENT_adp
  LANE_2_SEGMENT_4_ST_adp: Bus: SEGMENT_adp
  LANE_2_SEGMENT_5_ST_adp: Bus: SEGMENT_adp
  LANE_3_SEGMENT_0_ST_adp: Bus: SEGMENT_adp
  LANE_3_SEGMENT_1_ST_adp: Bus: SEGMENT_adp
  LANE_3_SEGMENT_2_ST_adp: Bus: SEGMENT_adp
  LANE_3_SEGMENT_3_ST_adp: Bus: SEGMENT_adp
  LANE_3_SEGMENT_4_ST_adp: Bus: SEGMENT_adp
  LANE_3_SEGMENT_5_ST_adp: Bus: SEGMENT_adp
  LANE_4_SEGMENT_0_ST_adp: Bus: SEGMENT_adp
  LANE_4_SEGMENT_1_ST_adp: Bus: SEGMENT_adp
  LANE_4_SEGMENT_2_ST_adp: Bus: SEGMENT_adp
  LANE_4_SEGMENT_3_ST_adp: Bus: SEGMENT_adp
  LANE_4_SEGMENT_4_ST_adp: Bus: SEGMENT_adp
  LANE_4_SEGMENT_5_ST_adp: Bus: SEGMENT_adp

TARGETOBJECTS_ST_adp = Simulink.Bus()
  LANE_0_TARGETOBJECT_0_ST: Bus: TARGETOBJECT_adp
  LANE_0_TARGETOBJECT_1_ST: Bus: TARGETOBJECT_adp
  LANE_0_TARGETOBJECT_2_ST: Bus: TARGETOBJECT_adp
  LANE_0_TARGETOBJECT_3_ST: Bus: TARGETOBJECT_adp
  LANE_0_TARGETOBJECT_4_ST: Bus: TARGETOBJECT_adp
  LANE_0_TARGETOBJECT_5_ST: Bus: TARGETOBJECT_adp
  LANE_0_TARGETOBJECT_6_ST: Bus: TARGETOBJECT_adp
  LANE_0_TARGETOBJECT_7_ST: Bus: TARGETOBJECT_adp
  LANE_0_TARGETOBJECT_8_ST: Bus: TARGETOBJECT_adp
  LANE_0_TARGETOBJECT_9_ST: Bus: TARGETOBJECT_adp
  LANE_1_TARGETOBJECT_0_ST: Bus: TARGETOBJECT_adp
  LANE_1_TARGETOBJECT_1_ST: Bus: TARGETOBJECT_adp
  LANE_1_TARGETOBJECT_2_ST: Bus: TARGETOBJECT_adp
  LANE_1_TARGETOBJECT_3_ST: Bus: TARGETOBJECT_adp
  LANE_1_TARGETOBJECT_4_ST: Bus: TARGETOBJECT_adp
  LANE_1_TARGETOBJECT_5_ST: Bus: TARGETOBJECT_adp
  LANE_1_TARGETOBJECT_6_ST: Bus: TARGETOBJECT_adp
  LANE_1_TARGETOBJECT_7_ST: Bus: TARGETOBJECT_adp
  LANE_1_TARGETOBJECT_8_ST: Bus: TARGETOBJECT_adp
  LANE_1_TARGETOBJECT_9_ST: Bus: TARGETOBJECT_adp
  LANE_2_TARGETOBJECT_0_ST: Bus: TARGETOBJECT_adp
  LANE_2_TARGETOBJECT_1_ST: Bus: TARGETOBJECT_adp
  LANE_2_TARGETOBJECT_2_ST: Bus: TARGETOBJECT_adp
  LANE_2_TARGETOBJECT_3_ST: Bus: TARGETOBJECT_adp
  LANE_2_TARGETOBJECT_4_ST: Bus: TARGETOBJECT_adp
  LANE_2_TARGETOBJECT_5_ST: Bus: TARGETOBJECT_adp
  LANE_2_TARGETOBJECT_6_ST: Bus: TARGETOBJECT_adp
  LANE_2_TARGETOBJECT_7_ST: Bus: TARGETOBJECT_adp
  LANE_2_TARGETOBJECT_8_ST: Bus: TARGETOBJECT_adp
  LANE_2_TARGETOBJECT_9_ST: Bus: TARGETOBJECT_adp
  LANE_3_TARGETOBJECT_0_ST: Bus: TARGETOBJECT_adp
  LANE_3_TARGETOBJECT_1_ST: Bus: TARGETOBJECT_adp
  LANE_3_TARGETOBJECT_2_ST: Bus: TARGETOBJECT_adp
  LANE_3_TARGETOBJECT_3_ST: Bus: TARGETOBJECT_adp
  LANE_3_TARGETOBJECT_4_ST: Bus: TARGETOBJECT_adp
  LANE_3_TARGETOBJECT_5_ST: Bus: TARGETOBJECT_adp
  LANE_3_TARGETOBJECT_6_ST: Bus: TARGETOBJECT_adp
  LANE_3_TARGETOBJECT_7_ST: Bus: TARGETOBJECT_adp
  LANE_3_TARGETOBJECT_8_ST: Bus: TARGETOBJECT_adp
  LANE_3_TARGETOBJECT_9_ST: Bus: TARGETOBJECT_adp
  LANE_4_TARGETOBJECT_0_ST: Bus: TARGETOBJECT_adp
  LANE_4_TARGETOBJECT_1_ST: Bus: TARGETOBJECT_adp
  LANE_4_TARGETOBJECT_2_ST: Bus: TARGETOBJECT_adp
  LANE_4_TARGETOBJECT_3_ST: Bus: TARGETOBJECT_adp
  LANE_4_TARGETOBJECT_4_ST: Bus: TARGETOBJECT_adp
  LANE_4_TARGETOBJECT_5_ST: Bus: TARGETOBJECT_adp
  LANE_4_TARGETOBJECT_6_ST: Bus: TARGETOBJECT_adp
  LANE_4_TARGETOBJECT_7_ST: Bus: TARGETOBJECT_adp
  LANE_4_TARGETOBJECT_8_ST: Bus: TARGETOBJECT_adp
  LANE_4_TARGETOBJECT_9_ST: Bus: TARGETOBJECT_adp

LANE_ST_adp = Simulink.Bus()
  ObjectList_st_0: Bus: TARGETOBJECT_adp  % There are 10 objects within a lane at most.its order depends on the distance to ego vehicle(consider sign):
    % like: -20,10,-10,60; its order in the object list: -20, -10, 10,60
  ObjectList_st_1: Bus: TARGETOBJECT_adp
  ObjectList_st_2: Bus: TARGETOBJECT_adp
  ObjectList_st_3: Bus: TARGETOBJECT_adp
  ObjectList_st_4: Bus: TARGETOBJECT_adp
  ObjectList_st_5: Bus: TARGETOBJECT_adp
  ObjectList_st_6: Bus: TARGETOBJECT_adp
  ObjectList_st_7: Bus: TARGETOBJECT_adp
  ObjectList_st_8: Bus: TARGETOBJECT_adp
  ObjectList_st_9: Bus: TARGETOBJECT_adp
  objectNum_un8: uint8  % There are 10 objects within a lane at most
  available_b: boolean  % False: unavailable
    % True: available
  front_lane_length_f: single
  rear_lane_length_f: single
  SRGMENT_0: Bus: SEGMENT_adp[6]  % A lane have 6 segments. There are 2 segments in rear of ego vehicle and 4 segments in front of ego vehicle
  SRGMENT_1: Bus: SEGMENT_adp
  SRGMENT_2: Bus: SEGMENT_adp
  SRGMENT_3: Bus: SEGMENT_adp
  SRGMENT_4: Bus: SEGMENT_adp
  SRGMENT_5: Bus: SEGMENT_adp

LANES_BAS_INFO_ST_adt = Simulink.Bus()
  lane_0: Bus: LANE_BAS_INFO_ST_adt
  lane_1: Bus: LANE_BAS_INFO_ST_adt
  lane_2: Bus: LANE_BAS_INFO_ST_adt
  lane_3: Bus: LANE_BAS_INFO_ST_adt
  lane_4: Bus: LANE_BAS_INFO_ST_adt

LANE_BAS_INFO_ST_adt = Simulink.Bus()
  objectNum_un8: uint8
  available_b: boolean
  lane_dwidth_f: single
  front_lane_length_f: single
  rear_lane_length_f: single

TARGETOBJECTS_10_dIM = Simulink.Bus()
  tar_obj_10_dims: Bus: TARGETOBJECT[10]

SEGMENTS_ST_6_DIM = Simulink.Bus()
  segments_st_6_dim: Bus: SEGMENT[6]

SEGMENT = Simulink.Bus()
  coef_arr_f: single[4]
  dlowerLimit_f: single
  dupperLimit_f: single
  numOfSegment_un8: uint8
  available_b: boolean
  detectedByVideo_b: boolean
  quality_f: single

LM_LANE_ST = Simulink.Bus()
  ObjectList_st: Bus: TARGETOBJECT[10]  % There are 10 objects within a lane at most.its order depends on the distance to ego vehicle(consider sign):
    % like: -20,10,-10,60; its order in the object list: -20, -10, 10,60
  objectNum_un8: uint8  % There are 10 objects within a lane at most
  available_b: boolean  % False: unavailable
    % True: available
  lane_dwidth_f: single
  front_lane_length_f: single
  rear_lane_length_f: single
  SRGMENT: Bus: SEGMENT[6]  % A lane have 6 segments. There are 2 segments in rear of ego vehicle and 4 segments in front of ego vehicle

LANEMODEL_OUTPUT_ST = Simulink.Bus()
  egoLaneID_un8: uint8  % ego vehicle lane:
    % from left to right, the num of lane is 0, 1, 2,,3,4;
    % 0:Lane_0
    % 1:Lane_1
    % 2:Lane_2
    % 3:Lane_3
    % 4:Lane_4
    % 255:unknow
  LANES_ST: Bus: LM_LANE_ST[5]  % there are 5 lanes in the  road at most

HMI_DISPLAY_ST = Simulink.Bus()
  objject_ID: uint8
  obj_type: uint8  % DEFAULT = 0,
    % PEDESTRIAN = 1,
    % BIKE = 2,
    % CAR = 3,
    % TRUCK = 4,
    % TRAFFIC_CONE = 5,
    % WATER_HORSE = 6
  dx: single
  dy: single
  obj_attr: uint8  % DEFAULT = 0,
    % TRUCK_EVASION = 1,
    % ACC_FRONT_CAR = 2,
    % CUT_IN = 3,
    % OBSTACLE_ON_ADJACENT_LANE = 4

HMI_OUTPUT_ST_APT = Simulink.Bus()
  obj_0: Bus: HMI_DISPLAY_ST
  obj_1: Bus: HMI_DISPLAY_ST
  obj_2: Bus: HMI_DISPLAY_ST
  obj_3: Bus: HMI_DISPLAY_ST
  obj_4: Bus: HMI_DISPLAY_ST
  obj_5: Bus: HMI_DISPLAY_ST
  obj_6: Bus: HMI_DISPLAY_ST
  obj_7: Bus: HMI_DISPLAY_ST
  obj_8: Bus: HMI_DISPLAY_ST
  obj_9: Bus: HMI_DISPLAY_ST
  obj_10: Bus: HMI_DISPLAY_ST
  obj_11: Bus: HMI_DISPLAY_ST
  obj_12: Bus: HMI_DISPLAY_ST
  obj_13: Bus: HMI_DISPLAY_ST
  obj_14: Bus: HMI_DISPLAY_ST
  obj_15: Bus: HMI_DISPLAY_ST
  obj_16: Bus: HMI_DISPLAY_ST
  obj_17: Bus: HMI_DISPLAY_ST
  obj_18: Bus: HMI_DISPLAY_ST
  obj_19: Bus: HMI_DISPLAY_ST
  obj_20: Bus: HMI_DISPLAY_ST
  obj_21: Bus: HMI_DISPLAY_ST
  obj_22: Bus: HMI_DISPLAY_ST
  obj_23: Bus: HMI_DISPLAY_ST
  obj_24: Bus: HMI_DISPLAY_ST
  obj_25: Bus: HMI_DISPLAY_ST
  obj_26: Bus: HMI_DISPLAY_ST
  obj_27: Bus: HMI_DISPLAY_ST
  obj_28: Bus: HMI_DISPLAY_ST
  obj_29: Bus: HMI_DISPLAY_ST
  obj_30: Bus: HMI_DISPLAY_ST
  obj_31: Bus: HMI_DISPLAY_ST

HMI_DISPLAY_ARRAY_ST = Simulink.Bus()
  hmi_display_array_st: Bus: HMI_DISPLAY_ST[32]

HMI_OUTPUT_ST = Simulink.Bus()
  count_obj: uint8
  hmi_display_info_st: Bus: HMI_DISPLAY_ARRAY_ST

NARROW_LANE_SUPPORT_OUTPUT_ST = Simulink.Bus()
  leftNRAActive_b: boolean
  rightNRAActive_b: boolean
  m_countLeftNRA: uint8
  m_countRightNRA: uint8
  d2LeftRE: single
  d2RightRE: single
  l_c0: single
  l_c1: single
  l_c2: single
  l_line_type: uint16
  l_start_x0: single
  l_end_x0: single
  r_c0: single
  r_c1: single
  r_c2: single
  r_line_type: uint16
  r_start_x0: single
  r_end_x0: single

HWA_TARGETOBJECT_OUTPUT_ADAPTER_ST = Simulink.Bus()
  L_NEIGHBORLANE_TAROBJ_0_ST: Bus: TARGETOBJECT_adp
  L_NEIGHBORLANE_TAROBJ_1_ST: Bus: TARGETOBJECT_adp
  L_NEIGHBORLANE_TAROBJ_2_ST: Bus: TARGETOBJECT_adp
  L_NEIGHBORLANE_TAROBJ_3_ST: Bus: TARGETOBJECT_adp
  EGOLANE_TAROBJ_0_ST: Bus: TARGETOBJECT_adp
  EGOLANE_TAROBJ_1_ST: Bus: TARGETOBJECT_adp
  EGOLANE_TAROBJ_2_ST: Bus: TARGETOBJECT_adp
  EGOLANE_TAROBJ_3_ST: Bus: TARGETOBJECT_adp
  R_NEIGHBORLANE_TAROBJ_0_ST: Bus: TARGETOBJECT_adp
  R_NEIGHBORLANE_TAROBJ_1_ST: Bus: TARGETOBJECT_adp
  R_NEIGHBORLANE_TAROBJ_2_ST: Bus: TARGETOBJECT_adp
  R_NEIGHBORLANE_TAROBJ_3_ST: Bus: TARGETOBJECT_adp