% Simulink data dictionary Manual_LC.sldd

P_alpha = Simulink.Parameter(0.01, DataType="single")
P_beta = Simulink.Parameter(0.7, DataType="single")
P_MAX_ITER = Simulink.Parameter(2000, DataType="single")
P_lateral_offset = Simulink.Parameter(3.5, DataType="single")
P_TOL = Simulink.Parameter(0.7, DataType="single")
P_MAX_KAPPA = Simulink.Parameter(0.002, DataType="single")

PlanningOutput = Simulink.Bus()  % the output contains infomation as follow:
  % 1,2 cols: under vehicle coordinate, the x,y positions of planned
  % trajectories;
  % 3,4 cols: w.r.t longitudinal intergration s, the lateral offset on
  % each sampled s, offset to left of reference line is positive, and
  % the other side is negative;
  % 5 cols: delta_heading of matched point vectors between reference
  % line and planned trajs, anti-clock wise from reference to planned
  % trajs is positive;
  % 6 cols: planned trajs kappa, vehicle turing left is positive and
  % turning right is negative;
  % 7 cols: velocity profile along the planned trajectory.
  % 8 cols: acceleration profile along the planned trajectory.
  x: double[400]
  y: double[400]
  s: double[400]
  lat_offset: double[400]
  delta_theta: double[400]
  kappa: double[400]
  v_profile: double[400]
  a_profile: double[400]