% Simulink data dictionary SIMU.sldd
% references Func_Global.sldd
% references AccTarSel.sldd
% references VSI_Local.sldd
% references VLC_Local.sldd

SIMU_DET_ST = Simulink.Bus()
  Measurement: double[3 1]
  Time: double
  MeasurementNoise: double[3 3]
  SensorIndex: double
  ObjectClassID: double

SIMU_FUS_ST = Simulink.Bus()
  Detections: Bus: SIMU_DET_ST[40]
  NumDetections: double

SIMU_LANEINPUT_ST = Simulink.Bus()
  leftHostLane_C0: single
  leftHostLane_C1: single
  leftHostLane_C2: single
  leftHostLane_C3: single
  rightHostLane_C0: single
  rightHostLane_C1: single
  rightHostLane_C2: single
  rightHostLane_C3: single

SIMU_LANEBOUNDARY_ST = Simulink.Bus()
  Curvature: double
  CurvatureDerivative: double
  CurveLength: double
  HeadingAngle: double
  LateralOffset: double
  BoundaryType: double
  Strength: double
  Width: double

SIMU_LANEOUTPUT_ST = Simulink.Bus()
  LaneBoundaries: Bus: SIMU_LANEBOUNDARY_ST[4]

SIMU_TARGET_ST = Simulink.Bus()
  Detections: Bus: SIMU_DET_ST
  NumDetections: double