% Simulink data dictionary VLC_Local.sldd
% references Func_Global.sldd

P_DC2ECMargin = Simulink.Parameter(0.1, DataType="single")
P_Kp = Simulink.Parameter(0.2, DataType="single")
P_A = Simulink.Parameter(2, DataType="single")
P_Cd = Simulink.Parameter(0.29, DataType="single")
P_dAxMax = Simulink.Parameter(2, DataType="single")
P_StandStillFactEC = Simulink.Parameter(1, DataType="single")
P_StandStillFactDC = Simulink.Parameter(1, DataType="single")
TransRatio = Simulink.Parameter(7.38, DataType="single")
m_Vehicle = Simulink.Parameter(2000, StorageClass="Const", DataType="single")
P_Cf = Simulink.Parameter(0.1, DataType="single")
P_Dev4IEnd = Simulink.Parameter(0.1, DataType="single")
P_tARefFilter = Simulink.Parameter(0.2, DataType="single")
P_aDiffaF = Simulink.Parameter(0.05, DataType="single")
P_dIRamp = Simulink.Parameter(1, DataType="single")
r_Wheel = Simulink.Parameter(0.347, DataType="single")
P_Ki = Simulink.Parameter(0.08, DataType="single")
P_DriveOffAdd = Simulink.Parameter(400, DataType="single")
P_dAxMin = Simulink.Parameter(-4, DataType="single")
P_tFxMergeFilter = Simulink.Parameter(0.1, DataType="single")
P_tSlopeFilter1 = Simulink.Parameter(0.4, DataType="single")
P_tSlopeFilter2 = Simulink.Parameter(0.1, DataType="single")
P_dSlopeLim = Simulink.Parameter(0.3, DataType="single")
P_tDriveOffThr = Simulink.Parameter(5, DataType="single")
P_vDriveOffThr = Simulink.Parameter(1.4, DataType="single")
P_SlopeMin = Simulink.Parameter(0.2, DataType="single")
P_SlopeMax = Simulink.Parameter(2, DataType="single")
P_aStsd = Simulink.Parameter(-1, DataType="single")
P_StsdCase = Simulink.Parameter(1, DataType="single")
P_StsddAxRamp = Simulink.Parameter(1, DataType="single")
P_vLowSpd = Simulink.Parameter(0.83, DataType="single")