% Simulink data dictionary VSI_Local.sldd
% references Func_Global.sldd

P_vLo = Simulink.Parameter(1, DataType="single")
P_vHi = Simulink.Parameter(3, DataType="single")
P_tSasFilt = Simulink.Parameter(0.25, DataType="single")
P_tYrsFilt = Simulink.Parameter(0.25, DataType="single")
d_WheelBase = Simulink.Parameter(2.8, DataType="single")
StRatio = Simulink.Parameter(15.2, DataType="single")
P_tARawFilt = Simulink.Parameter(0.2, DataType="single")
P_tAxsFilt = Simulink.Parameter(0.2, DataType="single")
P_tVVehFilt = Simulink.Parameter(0.3, DataType="single")