% Simulink data dictionary ZOP_Func.sldd

MODE_ZOP_ERROR = Simulink.Parameter(15, DataType="uint8")
MODE_ZOP_OFF = Simulink.Parameter(0, DataType="uint8")
MODE_ZOP_READY = Simulink.Parameter(2, DataType="uint8")
MODE_ZOP_ACTIVE = Simulink.Parameter(3, DataType="uint8")
MODE_ZOP_HOLD = Simulink.Parameter(6, DataType="uint8")
MODE_ZOP_LC = Simulink.Parameter(7, DataType="uint8")
MODE_ZOP_OVERIDE = Simulink.Parameter(8, DataType="uint8")
MODE_ZOP_FINISH = Simulink.Parameter(10, DataType="uint8")
MODE_ZOP_PASSIVE = Simulink.Parameter(1, DataType="uint8")
k_ZOP_LCTimeMax = Simulink.Parameter(15, DataType="single")

ZOP_Object_ST = Simulink.Bus()
  id: uint8
  x: single
  y: single
  vx: single
  vy: single
  ax: single
  ay: single
  dir: int8
  dir_f: int8
  exist: int8[2]

Light_Info_ST = Simulink.Bus()
  color: int8
  time: single
  dist: single

MapInfo_ST = Simulink.Bus()
  LaneNum: int8
  MapFlag: uint16
  TgtSpd: double
  isInZopZone: int8
  LaneIndex: int8
  LocIndex: int8
  Dist2Dest: single
  Dist2Start: single
  Dist2StopLine: single
  Dist2Merge: single
  LocLat: double
  LocLon: double
  SpeedLimit: single[3]  % 0,1,2 Right-->Left

MapInfo_ST_Post = Simulink.Bus()
  LaneNum: int8
  MapFlag: uint16
  TgtSpd: double
  isInZopZone: int8
  LaneIndex: int8
  LocIndex: int8
  Dist2Dest: single
  Dist2Start: single
  Dist2StopLine: single
  Dist2Merge: single
  LocLat: double
  LocLon: double
  SpeedLimit: single[3]  % 0,1,2 Right-->Left
  LaneStable: int8

k_ZOP_V2X_Enable = Simulink.Parameter(1, DataType="single")
k_ZOP_ALC_Enable = Simulink.Parameter(1, DataType="single")
k_ZOP_ALC_D10 = Simulink.Parameter(1500, DataType="single")
k_ZOP_MapFlag_Enable = Simulink.Parameter(0, DataType="single")
k_ZOP_ALC_SCnt = Simulink.Parameter(30, DataType="int8")
k_ZOP_ALC_SNCnt = Simulink.Parameter(30, DataType="int8")
k_ZOP_ALC_SCnt_Thr = Simulink.Parameter(15, DataType="int8")
k_ZOP_ALC_SCnt_LC = Simulink.Parameter(20, DataType="int8")
k_ZOP_ALC_SNCnt_LC = Simulink.Parameter(20, DataType="int8")
k_ZOP_ALC_SCnt_Thr_LC = Simulink.Parameter(15, DataType="int8")
k_ZOP_SpdLoTimeThr = Simulink.Parameter(50, DataType="int8")
k_ZOP_ObjSpd_cf = Simulink.Parameter(0.05, DataType="single")
k_ZOP_SpdCkDstThr = Simulink.Parameter(50, DataType="single")
k_ZOP_SpdLoThr = Simulink.Parameter(4, DataType="single")
k_ZOP_ALC_SpdEnable = Simulink.Parameter(0, DataType="int8")
k_ZOP_VoiceAct_Enable = Simulink.Parameter(1, DataType="single")
k_ZOP_SpdLmt_Enable = Simulink.Parameter(1, DataType="single")
k_ZOP_VcTJA_Enable = Simulink.Parameter(1, DataType="single")

ZOP_Var_ST = Simulink.Bus()
  LnLo: int8
  LnHi: int8
  LSafeNCnt: int8
  RSafeNCnt: int8
  LSafeCnt: int8
  RSafeCnt: int8
  LSafeRaw: int8
  RSafeRaw: int8
  Safe: int8
  holdTimeCnt: uint32
  lcTimeCnt: uint32
  lcProTimeCnt: uint32
  lcDirCnt: uint32
  LCResult: int8
  DesLane: int8
  CmdLane: int8
  LCDir: int8
  LCCmd: int8
  LCRes: uint16
  LCTip: uint16
  LCNRes: uint16
  LCTime: single
  LCDist: single
  FinishState: int8  % 0 = none, 1 = Succ, 2 = Fail
  LCFailTip: int8
  Spd: single[3]
  SpdTmp: single[3]
  SpdTimeCnt: uint32[3]
  MapFlag: uint16
  MapFlagDir: int8

k_ZOP_HoldCnt = Simulink.Parameter(50, DataType="single")
k_ZOP_LS_ChangingDist = Simulink.Parameter(5, DataType="single")
k_ZOP_LS_ChangingTime = Simulink.Parameter(0.5, DataType="single")
k_ZOP_ALC_Ramp = Simulink.Parameter(1, DataType="single")
k_ZOP_LCProCnt = Simulink.Parameter(15, DataType="single")