% Simulink data dictionary ZOP_Global.sldd

ZOP2LCK = Simulink.Bus()
  state: uint8
  activate_lck: uint8
  lc_cmd: int8

ZOP2TJA = Simulink.Bus()
  activate_tja: uint8
  is_zop_active: uint8

ZOP2ACC = Simulink.Bus()
  state: uint8
  activate_acc: uint8
  spd_lmt: single
  light_des_spd: single
  light_a_des: single
  case_num: int8
  light_dist: single

ACC_Status_ST = Simulink.Bus()
  state: uint8
  ready: uint8
  active: uint8
  overide: uint8
  cancle: uint8
  error: uint8

LKS_Status_ST = Simulink.Bus()
  state: uint8
  ready: uint8
  active: uint8
  overide: uint8
  cancle: uint8
  error: uint8
  lc_finish: uint8
  lc_fail: uint8
  lc_dist: single

SystemCmd_ST = Simulink.Bus()
  SystemEnable: uint8
  SystemOn: uint8
  SystemCancel: uint8

ACC_HMI_REQ = Simulink.Bus()
  TimeGapSet: uint8
  ACC_Enable: uint8
  vSetAccSpd: single

ZOP_HMI_REQ = Simulink.Bus()
  ZOP_Enable: uint8
  ZOP_Destination_Target: uint8
  Function_Activation: uint8
  DMS_DriverEye_St: uint8
  LC_Req: uint8

ZOP2HMI = Simulink.Bus()
  LCDir: int8
  LCRes: int8
  LCTip: int8
  LCFailTip: int8
  LCReqTip: int8
  LCProp: int8
  LCPropRes: int8