% Simulink data dictionary fusionAlg.sldd
% references Func_Global.sldd
% references VSI_Local.sldd
% references ARS308_RX.sldd
% references EYEQ4_RX.sldd

FUS_UINT32_RESERVED_ST = Simulink.Bus()
  reserved0: uint32
  reserved1: uint32

FUS_UINT8_RESERVED_ST = Simulink.Bus()
  reserved1: uint8
  reserved0: uint8

FUS_RADAR_STATE_ST = Simulink.Bus()
  hostYaw: single
  hostSpeed: single
  timeStamp: uint16
  statusHWErr: uint8
  statusBlkProg: uint8
  statusMisAlign: uint8
  sGUFail: uint8
  measEnabled: uint8
  msgAliveCounter: uint8
  latency: uint8
  msgCheckSum: uint8
  reservedField: Bus: FUS_UINT8_RESERVED_ST

FUS_RADOBJ_LIST_ST = Simulink.Bus()
  radar_01_obj: Bus: FUS_RADAR_OBJ_ST
  radar_02_obj: Bus: FUS_RADAR_OBJ_ST
  radar_03_obj: Bus: FUS_RADAR_OBJ_ST
  radar_04_obj: Bus: FUS_RADAR_OBJ_ST
  radar_05_obj: Bus: FUS_RADAR_OBJ_ST
  radar_06_obj: Bus: FUS_RADAR_OBJ_ST
  radar_07_obj: Bus: FUS_RADAR_OBJ_ST
  radar_08_obj: Bus: FUS_RADAR_OBJ_ST
  radar_09_obj: Bus: FUS_RADAR_OBJ_ST
  radar_10_obj: Bus: FUS_RADAR_OBJ_ST
  radar_11_obj: Bus: FUS_RADAR_OBJ_ST
  radar_12_obj: Bus: FUS_RADAR_OBJ_ST
  radar_13_obj: Bus: FUS_RADAR_OBJ_ST
  radar_14_obj: Bus: FUS_RADAR_OBJ_ST
  radar_15_obj: Bus: FUS_RADAR_OBJ_ST
  radar_16_obj: Bus: FUS_RADAR_OBJ_ST
  radar_17_obj: Bus: FUS_RADAR_OBJ_ST
  radar_18_obj: Bus: FUS_RADAR_OBJ_ST
  radar_19_obj: Bus: FUS_RADAR_OBJ_ST
  radar_20_obj: Bus: FUS_RADAR_OBJ_ST
  radar_21_obj: Bus: FUS_RADAR_OBJ_ST
  radar_22_obj: Bus: FUS_RADAR_OBJ_ST
  radar_23_obj: Bus: FUS_RADAR_OBJ_ST
  radar_24_obj: Bus: FUS_RADAR_OBJ_ST
  radar_25_obj: Bus: FUS_RADAR_OBJ_ST
  radar_26_obj: Bus: FUS_RADAR_OBJ_ST
  radar_27_obj: Bus: FUS_RADAR_OBJ_ST
  radar_28_obj: Bus: FUS_RADAR_OBJ_ST
  radar_29_obj: Bus: FUS_RADAR_OBJ_ST
  radar_30_obj: Bus: FUS_RADAR_OBJ_ST
  radar_31_obj: Bus: FUS_RADAR_OBJ_ST
  radar_32_obj: Bus: FUS_RADAR_OBJ_ST
  radar_33_obj: Bus: FUS_RADAR_OBJ_ST
  radar_34_obj: Bus: FUS_RADAR_OBJ_ST
  radar_35_obj: Bus: FUS_RADAR_OBJ_ST
  radar_36_obj: Bus: FUS_RADAR_OBJ_ST
  radar_37_obj: Bus: FUS_RADAR_OBJ_ST
  radar_38_obj: Bus: FUS_RADAR_OBJ_ST
  radar_39_obj: Bus: FUS_RADAR_OBJ_ST
  radar_40_obj: Bus: FUS_RADAR_OBJ_ST

FUS_RADAR_DATA_ST = Simulink.Bus()
  timestamp: double
  frameNum: uint32
  count: uint32
  errType: uint32
  radarObj: Bus: FUS_RADOBJ_LIST_ST
  radarState: Bus: FUS_RADAR_STATE_ST
  reserved: Bus: FUS_UINT32_RESERVED_ST

FUS_OBJALG_ST = Simulink.Bus()
  timeStamp: double  % Common timestamp for all object and barrier signals
  objects: Bus: FUS_OUTOBJ_LIST_ST
  frameNum: uint32  % frame nmber

FUS_Radar410_st = Simulink.Signal()
FUS_EgoMotion_st = Simulink.Signal()

FUS_OUTOBJ_LIST_ST = Simulink.Bus()
  fus_output_01_obj: Bus: FUS_OBJ_DATA_ST
  fus_output_02_obj: Bus: FUS_OBJ_DATA_ST
  fus_output_03_obj: Bus: FUS_OBJ_DATA_ST
  fus_output_04_obj: Bus: FUS_OBJ_DATA_ST
  fus_output_05_obj: Bus: FUS_OBJ_DATA_ST
  fus_output_06_obj: Bus: FUS_OBJ_DATA_ST
  fus_output_07_obj: Bus: FUS_OBJ_DATA_ST
  fus_output_08_obj: Bus: FUS_OBJ_DATA_ST
  fus_output_09_obj: Bus: FUS_OBJ_DATA_ST
  fus_output_10_obj: Bus: FUS_OBJ_DATA_ST
  fus_output_11_obj: Bus: FUS_OBJ_DATA_ST
  fus_output_12_obj: Bus: FUS_OBJ_DATA_ST
  fus_output_13_obj: Bus: FUS_OBJ_DATA_ST
  fus_output_14_obj: Bus: FUS_OBJ_DATA_ST
  fus_output_15_obj: Bus: FUS_OBJ_DATA_ST
  fus_output_16_obj: Bus: FUS_OBJ_DATA_ST
  fus_output_17_obj: Bus: FUS_OBJ_DATA_ST
  fus_output_18_obj: Bus: FUS_OBJ_DATA_ST
  fus_output_19_obj: Bus: FUS_OBJ_DATA_ST
  fus_output_20_obj: Bus: FUS_OBJ_DATA_ST
  fus_output_21_obj: Bus: FUS_OBJ_DATA_ST
  fus_output_22_obj: Bus: FUS_OBJ_DATA_ST
  fus_output_23_obj: Bus: FUS_OBJ_DATA_ST
  fus_output_24_obj: Bus: FUS_OBJ_DATA_ST
  fus_output_25_obj: Bus: FUS_OBJ_DATA_ST
  fus_output_26_obj: Bus: FUS_OBJ_DATA_ST
  fus_output_27_obj: Bus: FUS_OBJ_DATA_ST
  fus_output_28_obj: Bus: FUS_OBJ_DATA_ST
  fus_output_29_obj: Bus: FUS_OBJ_DATA_ST
  fus_output_30_obj: Bus: FUS_OBJ_DATA_ST
  fus_output_31_obj: Bus: FUS_OBJ_DATA_ST
  fus_output_32_obj: Bus: FUS_OBJ_DATA_ST
  fus_output_33_obj: Bus: FUS_OBJ_DATA_ST
  fus_output_34_obj: Bus: FUS_OBJ_DATA_ST
  fus_output_35_obj: Bus: FUS_OBJ_DATA_ST
  fus_output_36_obj: Bus: FUS_OBJ_DATA_ST
  fus_output_37_obj: Bus: FUS_OBJ_DATA_ST
  fus_output_38_obj: Bus: FUS_OBJ_DATA_ST
  fus_output_39_obj: Bus: FUS_OBJ_DATA_ST
  fus_output_40_obj: Bus: FUS_OBJ_DATA_ST

FUS_VISION_OBJ_ACCE_ST = Simulink.Bus()
  Ax: single
  AxVariance: single
  Ay: single
  AyVariance: single

FUS_VISOBJ_UINT8_RESERVED_ST = Simulink.Bus()
  reserved0: uint8
  reserved1: uint8
  reserved2: uint8

FUS_VISION_OBJ_ANGLE_ST = Simulink.Bus()
  centerAngle: single
  centerAngleVariance: single

FUS_VISION_OBJ_VELOCITY = Simulink.Bus()
  Vx: single
  VxVariance: single
  Vy: single
  VyVariance: single

FUS_VISION_OBJ_COORD_ST = Simulink.Bus()
  lateral: single
  lateralVariance: single
  longitudinal: single
  longitudinalVariance: single

FUS_VISION_OBJ_BOUNDARY = Simulink.Bus()
  X1: int16
  Y1: int16
  X2: int16
  Y2: int16

FUS_VISION_OBJ_STAGE_AGE_ST = Simulink.Bus()  % Object total age and stage age, lifetime in frames
  totalAge: uint16
  initAge: uint16
  measureAge: uint16
  predictAge: uint16

FUS_VISION_OBJ_ST = Simulink.Bus()
  obj_ID: uint32  % Object ID
  obj_status: uint32  % vision object status
    % 0:Initialized,
    % 1:Measured,
    % 2:Predicted,
  obj_stageAge: Bus: FUS_VISION_OBJ_STAGE_AGE_ST
  obj_boundary: Bus: FUS_VISION_OBJ_BOUNDARY  % Object Bounding box pixel location on the image plane
  obj_type: uint32  % Object classification
    % 0: Unknown
    % 1: Pedestrian
    % 2: Vehicle
    % Between car and truck, at the moment, it is not supported
  obj_typeConf: uint32  % type confidence value. ([1, 100])
  obj_coordinate: Bus: FUS_VISION_OBJ_COORD_ST
  obj_velocity: Bus: FUS_VISION_OBJ_VELOCITY
  obj_angleOfCenter: Bus: FUS_VISION_OBJ_ANGLE_ST
  obj_TTC: single  % Object time-to-collision estimation (TTC)
  obj_TTCVariance: single  % variance measurement
  obj_acceleration: Bus: FUS_VISION_OBJ_ACCE_ST  % Object acceleration
  obj_existProb: single  % Object existence probability
  AyVariance: Bus: FUS_VISION_BOXSIZE_ST  % Length/Width/Height of Object
  obj_angleOfObject: uint8  % For vehicle, angles are quantized in 8 directions. For pedestrians, and two wheelers, angles are quantized in 4 directions. (anti-clockwise direction)0- Front 1-Left Front 2-Left 3-Rear Left 4-Rear 5-Rear Right 6-Right 7-Front Right
  reserved1: Bus: FUS_VISOBJ_UINT8_RESERVED_ST
  obj_Heading: single
  obj_Heading_STD: single
  obj_Heading_V: single
  obj_Heading_STD_V: single
  reserved2: Bus: FUS_VISOBJ_UINT32_RESERVED_ST

FUS_VISION_BOXSIZE_ST = Simulink.Bus()
  length: single
  width: single
  height: single

FUS_VISOBJ_UINT32_RESERVED_ST = Simulink.Bus()
  reserved0: uint32
  reserved1: uint32

FUS_VISION_OBJ_DATA_ST = Simulink.Bus()
  timestamp: double
  frameNum: uint32
  count: uint8
  reserved: Bus: FUS_VISOBJ_UINT8_RESERVED_ST
  objList: Bus: FUS_VISION_OBJ_LIST_ST
  dayNightState: uint32  % 0:night 1:twilight 2:day 255:unkown
  reserved1: Bus: FUS_VISOBJ_UINT32_RESERVED_ST

FUS_VISION_OBJ_LIST_ST = Simulink.Bus()
  vision_01_obj: Bus: FUS_VISION_OBJ_ST
  vision_02_obj: Bus: FUS_VISION_OBJ_ST
  vision_03_obj: Bus: FUS_VISION_OBJ_ST
  vision_04_obj: Bus: FUS_VISION_OBJ_ST
  vision_05_obj: Bus: FUS_VISION_OBJ_ST
  vision_06_obj: Bus: FUS_VISION_OBJ_ST
  vision_07_obj: Bus: FUS_VISION_OBJ_ST
  vision_08_obj: Bus: FUS_VISION_OBJ_ST
  vision_09_obj: Bus: FUS_VISION_OBJ_ST
  vision_10_obj: Bus: FUS_VISION_OBJ_ST
  vision_11_obj: Bus: FUS_VISION_OBJ_ST
  vision_12_obj: Bus: FUS_VISION_OBJ_ST
  vision_13_obj: Bus: FUS_VISION_OBJ_ST
  vision_14_obj: Bus: FUS_VISION_OBJ_ST
  vision_15_obj: Bus: FUS_VISION_OBJ_ST
  vision_16_obj: Bus: FUS_VISION_OBJ_ST
  vision_17_obj: Bus: FUS_VISION_OBJ_ST
  vision_18_obj: Bus: FUS_VISION_OBJ_ST
  vision_19_obj: Bus: FUS_VISION_OBJ_ST
  vision_20_obj: Bus: FUS_VISION_OBJ_ST
  vision_21_obj: Bus: FUS_VISION_OBJ_ST
  vision_22_obj: Bus: FUS_VISION_OBJ_ST
  vision_23_obj: Bus: FUS_VISION_OBJ_ST
  vision_24_obj: Bus: FUS_VISION_OBJ_ST
  vision_25_obj: Bus: FUS_VISION_OBJ_ST
  vision_26_obj: Bus: FUS_VISION_OBJ_ST
  vision_27_obj: Bus: FUS_VISION_OBJ_ST
  vision_28_obj: Bus: FUS_VISION_OBJ_ST
  vision_29_obj: Bus: FUS_VISION_OBJ_ST
  vision_30_obj: Bus: FUS_VISION_OBJ_ST
  vision_31_obj: Bus: FUS_VISION_OBJ_ST
  vision_32_obj: Bus: FUS_VISION_OBJ_ST
  vision_33_obj: Bus: FUS_VISION_OBJ_ST
  vision_34_obj: Bus: FUS_VISION_OBJ_ST
  vision_35_obj: Bus: FUS_VISION_OBJ_ST
  vision_36_obj: Bus: FUS_VISION_OBJ_ST
  vision_37_obj: Bus: FUS_VISION_OBJ_ST
  vision_38_obj: Bus: FUS_VISION_OBJ_ST
  vision_39_obj: Bus: FUS_VISION_OBJ_ST
  vision_40_obj: Bus: FUS_VISION_OBJ_ST

FUS_VisObj_st = Simulink.Signal(DataType="Bus: FUS_VISION_OBJ_DATA_ST")
FUS_VisLane_st = Simulink.Signal(DataType="Bus: FUS_EYEQ4_LANE_DATA_ST")
FUS_LaneOutput_st = Simulink.Signal(DataType="Bus: FUS_LANE_OUTPUT_ST")

FUS_VEHICLE_DATA_ST = Simulink.Bus()
  yawRate: single
  motionStatus: single
  speed: single
  acceleration: single

FUS_EYEQ4_ROADEDGE_PROT_ST = Simulink.Bus()
  lreage: uint32
  lreexistprob: single
  lretype: uint32
  lreid: uint32
  lrelineC0: single
  lrelineC1: single
  lrelineC2: single
  lrelineC3: single
  lrevrStart: single
  lrevrEnd: single
  lreside: uint32
  lreheight: single
  lreheightstd: single
  lreindex: uint32

FUS_EYEQ4_ROADEDGE_DATA_ST = Simulink.Bus()
  timestamp: double
  frameNum: uint32
  roadEdgeProtHeader: Bus: FUS_EYEQ4_ROADEDGE_PROT_ST
  roadEdgeProtA: Bus: FUS_EYEQ4_ROADEDGE_PROT_ST
  roadEdgeProtB: Bus: FUS_EYEQ4_ROADEDGE_PROT_ST
  roadEdgeProtC: Bus: FUS_EYEQ4_ROADEDGE_PROT_ST
  errorFlag: uint32
  reserved: uint32

FUS_VisRoadEdge_st = Simulink.Signal(DataType="Bus: FUS_EYEQ4_ROADEDGE_DATA_ST")

FUS_EYEQ4_LANE_PROT_ST = Simulink.Bus()
  lhlinefirstC0: single  % coefficient a
  lhlinefirstC1: single
  lhlinefirstC2: single  % coefficient c
  lhlinefirstC3: single  % coefficient d
  lhside: uint32
  lhfirstvrStart: single
  lhfirstvrEnd: single
  lhtrackid: uint32
  lhcolor: uint32
  lhmarkerwidth: single
  lhmarkerwidthSTD: single
  lhexistenceprobability: single
  lhlanemarktype: uint32
  lhlanemarktypeconf: uint32
  lhdlmtype: uint32

FUS_EYEQ4_LANE_ADJA_ST = Simulink.Bus()
  lhlinefirstC0: single  % coefficient a
  lhlinefirstC1: single
  lhlinefirstC2: single  % coefficient c
  lhlinefirstC3: single  % coefficient d
  linerole: uint32
  lanetrackid: uint32
  age: uint32
  color: uint32
  colorconf: uint32
  lanemarkerwidth: single
  lanemarkerwidthSTD: single
  lavrstart: single
  lavrend: single
  laexistprobalility: single
  lalanemarktype: uint32
  lalanemarktypeconf: uint32
  ladlmtype: uint32

FUS_EYEQ4_LANE_PROT_HEADER_ST = Simulink.Bus()
  lhsyncid: uint32
  lhlanecount: uint32
  lhestimatedwidth: single
  lhsnowonroadprob: single

FUS_EYEQ4_LANE_DATA_ST = Simulink.Bus()
  timestamp: double
  frameNum: uint32
  laneChangeStatus: uint32  % 0:No lane change,
    % 1:Lane change to the left,
    % 2:Lane change to the right
  laneHostProtHeader: Bus: FUS_EYEQ4_LANE_PROT_HEADER_ST
  laneHostProtA: Bus: FUS_EYEQ4_LANE_PROT_ST
  laneHostProtB: Bus: FUS_EYEQ4_LANE_PROT_ST
  laneAdjaProtA: Bus: FUS_EYEQ4_LANE_ADJA_ST
  laneAdjaProtB: Bus: FUS_EYEQ4_LANE_ADJA_ST
  laneAdjaProtC: Bus: FUS_EYEQ4_LANE_ADJA_ST
  laneAdjaProtD: Bus: FUS_EYEQ4_LANE_ADJA_ST
  errorFlag: uint32
  reserved: uint32

FUS_RoadEdgeOutput_st = Simulink.Signal(DataType="Bus: FUS_ROAD_EDGE_OUTPUT_ST")

FUS_ARS308_LIST_ST = Simulink.Bus()
  radar308_01_obj: Bus: FUS_ARS308_OBJ_ST
  radar308_02_obj: Bus: FUS_ARS308_OBJ_ST
  radar308_03_obj: Bus: FUS_ARS308_OBJ_ST
  radar308_04_obj: Bus: FUS_ARS308_OBJ_ST
  radar308_05_obj: Bus: FUS_ARS308_OBJ_ST
  radar308_06_obj: Bus: FUS_ARS308_OBJ_ST
  radar308_07_obj: Bus: FUS_ARS308_OBJ_ST
  radar308_08_obj: Bus: FUS_ARS308_OBJ_ST
  radar308_09_obj: Bus: FUS_ARS308_OBJ_ST
  radar308_10_obj: Bus: FUS_ARS308_OBJ_ST
  radar308_11_obj: Bus: FUS_ARS308_OBJ_ST
  radar308_12_obj: Bus: FUS_ARS308_OBJ_ST
  radar308_13_obj: Bus: FUS_ARS308_OBJ_ST
  radar308_14_obj: Bus: FUS_ARS308_OBJ_ST
  radar308_15_obj: Bus: FUS_ARS308_OBJ_ST
  radar308_16_obj: Bus: FUS_ARS308_OBJ_ST
  radar308_17_obj: Bus: FUS_ARS308_OBJ_ST
  radar308_18_obj: Bus: FUS_ARS308_OBJ_ST
  radar308_19_obj: Bus: FUS_ARS308_OBJ_ST
  radar308_20_obj: Bus: FUS_ARS308_OBJ_ST
  radar308_21_obj: Bus: FUS_ARS308_OBJ_ST
  radar308_22_obj: Bus: FUS_ARS308_OBJ_ST
  radar308_23_obj: Bus: FUS_ARS308_OBJ_ST
  radar308_24_obj: Bus: FUS_ARS308_OBJ_ST
  radar308_25_obj: Bus: FUS_ARS308_OBJ_ST
  radar308_26_obj: Bus: FUS_ARS308_OBJ_ST
  radar308_27_obj: Bus: FUS_ARS308_OBJ_ST
  radar308_28_obj: Bus: FUS_ARS308_OBJ_ST
  radar308_29_obj: Bus: FUS_ARS308_OBJ_ST
  radar308_30_obj: Bus: FUS_ARS308_OBJ_ST
  radar308_31_obj: Bus: FUS_ARS308_OBJ_ST
  radar308_32_obj: Bus: FUS_ARS308_OBJ_ST
  radar308_33_obj: Bus: FUS_ARS308_OBJ_ST
  radar308_34_obj: Bus: FUS_ARS308_OBJ_ST
  radar308_35_obj: Bus: FUS_ARS308_OBJ_ST
  radar308_36_obj: Bus: FUS_ARS308_OBJ_ST
  radar308_37_obj: Bus: FUS_ARS308_OBJ_ST
  radar308_38_obj: Bus: FUS_ARS308_OBJ_ST
  radar308_39_obj: Bus: FUS_ARS308_OBJ_ST

FUS_ARS308_OBJ_ST = Simulink.Bus()
  motionPattern: uint8
  objYVelRel: single  % object relative lat velocity
  objXVelRel: single  % Object relative longitudinal velocity
  objYPos: single  % Object lateral displacement
  objXPos: single  % Object longitudinal displacement
  id: uint16

FUS_ARS308_DATA_ST = Simulink.Bus()
  leftFrontRadar: Bus: FUS_RADAR_DATA_ST
  rightFrontRadar: Bus: FUS_RADAR_DATA_ST
  rightRearRadar: Bus: FUS_RADAR_DATA_ST
  leftRearRadar: Bus: FUS_RADAR_DATA_ST

FUS_Radar308_st = Simulink.Signal(DataType="Bus: FUS_ARS308_DATA_ST")

FUS_RADAR_OBJ_ST = Simulink.Bus()
  objObstacleProb: single
  objXPos_Stdev: single
  objYPos_Stdev: single
  objXVelRel_Stdev: single
  objXAccRel: single
  objExstProb: single
  objYVelRel: single
  objXVelRel: single
  objXPos: single
  objYPos: single
  objID: uint16
  objUpdateFlag: uint8
  objValidFlag: uint8
  objMotionPattern: uint8
  objType: uint8
  objMeasFlag: uint8
  reserved: Bus: FUS_UINT8_RESERVED_ST