% Simulink data dictionary test_on_structure.sldd

PlanningOutput = Simulink.Bus()  % the output contains infomation as follow:
  % 1,2 cols: under vehicle coordinate, the x,y positions of planned
  % trajectories;
  % 3,4 cols: w.r.t longitudinal intergration s, the lateral offset on
  % each sampled s, offset to left of reference line is positive, and
  % the other side is negative;
  % 5 cols: delta_heading of matched point vectors between reference
  % line and planned trajs, anti-clock wise from reference to planned
  % trajs is positive;
  % 6 cols: planned trajs kappa, vehicle turing left is positive and
  % turning right is negative;
  % 7 cols: velocity profile along the planned trajectory.
  % 8 cols: acceleration profile along the planned trajectory.
  x: double[1000]
  y: double[1000]
  s: double[1000]
  lat_offset: double[1000]
  delta_theta: double[1000]
  kappa: double[1000]
  v_profile: double[1000]
  a_profile: double[1000]

struct = Simulink.Bus()
  a: double[50]
  b: double[50]